vi "Main.gvi"   [LabVIEW NXG 5.0.0]
# This template is for the Queued Message Handler design pattern. The Event Handling Loop generates messages based on user interface actions. The Message Handling Loop processes messages generated by the Event Handling Loop, or by other messages. The messages are string values, so new messages can be added easily to the Message Cases case structure in the Message Handling Loop. Each message cluster can also provide an optional value for Message Data, which is a variant that can be converted to whatever message-specific data is required.
panel controls:
  "Exit": bool
  "CMD Button": bool
  "Initialize Software": bool
  "Panel Config Button": bool
  "Set PV Angle Button": bool
  "IR Thermometer Position": bool
  "Fans Button": bool
  "Brightness Config Button": bool
  "Optic Filter Config Button": bool
  "Panel Config Selector": string
  "PV Angle": i32
  "Fans Selector": string
  "Optic Filter Selector": string
  "IR Thermometer Position Selector": string
  "Light Power": i32
  "Manual Command to Arduino": string = "@DO 34 0#"
  "Set LoadR": bool
  "No Load": bool
  "Set LoadRTotal": string
  "VAC Button": bool
  "Heat Selector": string
  "Heat Button": bool
  "Exit 2": bool
  "Do Something": bool
  "Do Something Else": bool
  "Tab": i32
  "LoadR1": string
  "LoadR10": string
  "LoadR100": string
  "LoadR1000": string
  "Measured Data": "Measured Data.gtype"
  "Receive MV": bool
  "Arduino COM Port": "VISA Instr" = "COM5"
  "Panel Type Config Button": bool
  "Panel Type Config": string
  "Load Type Config Button": bool
  "Load Type Config": string
  "VAC Pause": bool
  "VAC Stop": bool
  "Button": bool
  "Current array": f64[]
  "Total Load temp": f64[]
  "Voltage temp": f64[]
  "VAC Volt": f64[]
  "VAC Cur": f64[]
  "VAC Load": f64[]
  "VAC measurements": i32 = 20
  "Reset Button": bool
panel indicators:
  "Display": string
  "Arduino Command Reply": "ArduinoReply.gtype"
  "Hardware Status": string
  "Voltage 1": f64
  "Current 1": f64
  "VAC Load Counter": i32
  "MV-Panel Configuration": string
  "MV-Cooling": string
  "MV-Heating": string
  "MV-Optical Filter": string
  "MV-Panel Tilt Angle": string
  "MV-Light Power": string
  "MV-LoadR1": string
  "MV-LoadR2": string
  "MV-LoadR3": string
  "MV-LoadR4": string
  "API Key": string
  "Server URL": string
  "Status of Send to SystemLink Cycle": string
  "PV-Current, mA": f64
  "SendDoubleToCloud": string
  "PV-LoadR,Ohm": f64
  "PV-Voltage, V": f64
  "PV-Temperature, ºC": f64
  "PV-LightIntensity, W/m2": f64
  "PV-Panel Tilt Angle, º": f64
  "PV-Panel Cofiguration": string
  "SendStringToCloud": string
  "PV-Cooling": string
  "PV-Heating": string
  "PV-Optical Filter": string
  "PV-LoadR1": string
  "PV-LoadR2": string
  "PV-LoadR3": string
  "PV-LoadR4": string
  "Error out Systemlink Read Cycle": error
  "Arduino Status": string
  "SendArrayDoubleToCloud": string
  "TempSensor": f64
  "LuxSensor": f64
  "Set Load R": i32
  "MV-LoadRTotal": string
  "TempSensor IR": f64
  "PV-LoadRTotal": string
  "PV-Temperature IR Position": string
  "PV-LigthPower, %": f64
  "PV-Temperature IR, ºC": f64
  "Total LoadR_SET": string
  "Dimmer": f64
  "VOLTShunt1": f64
  "Power1": f64
  "I-V Curve (VAC)": cluster{"Element 1": f64[], "Element 2": f64[]}
  "Load Reply": string
  "Chart Volt": f64
  "Chart Current": f64
  "Chart Load": i32
  "Chart Lux": f64
  "Chart Temperature": f64
  "PV-Lab Status": string
  "Arduino Status_2": bool
  "Voltage220": f64
types:
  "ArduinoReply.gtype" = cluster{"Timestamp": timestamp, "DATA": string}
  "Measured Data.gtype" = cluster{"Voltage, V": f64, "Current, mA": f64, "Luminous Flux, Lux": f64, "Temperature, GradC": f64, "Temperature IR, GradC": f64}
  "UI Data.gtype" = cluster{"Boolean": bool, "String": string, "Numeric": f64}
uses:
  NI::Skyline::Configuration::Open Configuration API Key.gvi
  NI::Skyline::TagHTTP::Query Tags.gvi
  NI::Skyline::TagHTTP::Open Tag.gvi
  NI::Skyline::TagHTTP::Read Tag (String).gvi
  NI::Skyline::TagHTTP::Close Tag (Single).gvi
  NI::Skyline::Configuration::Close Configuration.gvi
  Message Queue::Create All Message Queues.gvi
  Message Queue::Enqueue Message (Single).gvi
  Support::Error Handler - Event Handling Loop.gvi
  Message Queue::Dequeue Message.gvi
  NI::VISA::Configure Serial Port (Instr).gvi
  NI::VISA::Open (Instr).gvi
  Queued Message Handler::VISA WriteRead.gvi
  Queued Message Handler::VISA Reply Parse.gvi
  Queued Message Handler::Panel Switch.gvi
  Queued Message Handler::VISA Multiple Write.gvi
  NI::Analysis::Statistics::Mean (DBL).gvi
  NI::G Core::Error::Display Error.gvi
  NI::VISA::Close (Instr).gvi
  NI::G Core::Error::Build Error Cluster.gvi
  Support::Error Handler - Message Handling Loop.gvi
  NI::Skyline::TagHTTP::Write Tag (DBL).gvi
  NI::Skyline::TagHTTP::Write Tag (String).gvi
  NI::Vision::IMAQdx::Initialize.gvi
  NI::Vision::IMAQdx::Configure Grab.gvi
  NI::Vision::Core::Basics::Create Image.gvi
  NI::Vision::IMAQdx::Grab.gvi
  NI::Vision::IMAQdx::Close.gvi
diagram:
  $"MV-Panel Configuration" <- ""
  $"MV-Cooling" <- ""
  $"MV-Heating" <- ""
  $"MV-Optical Filter" <- ""
  $"MV-Panel Tilt Angle" <- ""
  $"MV-Light Power" <- ""
  $"MV-LoadR1" <- ""
  $"MV-LoadR2" <- ""
  $"MV-LoadR3" <- ""
  $"MV-LoadR4" <- ""
  $"MV-LoadRTotal" <- ""
  # PV Config
  # 	Single
  # 	Parallel 2
  # 	Parallel 2 Diode
  # 	Series 2
  # 	Series 2 Diode
  # 	Parallel 4
  # 	Parallel 4 Diode
  # 	Series 4
  # 	Series 4 Diode
  # 	Parallel Of Series
  # 	Parallel Of Series Diode
  # 	Series Of Parallel
  # 	Series Of Parallel Diode
  # Optic Filter Config
  # 	No Filter
  # 	Filter 1
  # 	Filter 2
  # IR Thermomether
  # 	None
  # 	Panel 1
  # 	Panel 2
  # 	Panel 3
  # 	Panel 4
  # Heating/Cooling
  # 	0
  # 	50
  # 	100
  # Light Power
  # 	0 ... 100
  # Panel Tilt Angle
  # 	0 ... 120
  # Load 1
  # 	1,2,3,5;
  # Load 2
  # 	10,20.40,50;
  # Load 3
  # 	100,200,400,500;
  # Load 4
  # 	1000,2000,4000;
  w1 = ["MV-Panels Configuration", "MV-Cooling", "MV-Heating", "MV-Optical Filter", "MV-Panel Tilt Angle", "MV-Light Power", "MV-LoadR1", "MV-LoadR2", "MV-LoadR3", "MV-LoadR4", "MV-LoadRTotal"]
  Array Size(array=w1) -> (size(s)=w2)
  Initialize Array(element=1904-12-31T23:00:00Z, size=w2) -> w3
  sequence {
    frame 0 {
      Wait(time to wait=20000)
    }
  }
  s1 = w3  # shift register
  while {
    Wait(time to wait=500)
    case ($"Receive MV") {
      frame False, Default {
        w4 = s1
      }
      frame True {
        call "Open Configuration API Key.gvi"(server url=$"Server URL", api key=$"API Key") -> (configuration=w5, error out=w6)
        call "Query Tags.gvi"(paths=w1, error in=w6, configuration=w5) -> (tags=w7, error out=w8)
        Build Array(reference to "MV-Panel Configuration", reference to "MV-Cooling", reference to "MV-Heating", reference to "MV-Optical Filter", reference to "MV-Panel Tilt Angle", reference to "MV-Light Power", reference to "MV-LoadR1", reference to "MV-LoadR2", reference to "MV-LoadR3", reference to "MV-LoadR4", reference to "MV-LoadRTotal") -> w9
        for {
          w10 = each element of w7
          w11 = each element of s1
          w12 = each element of w9
          Property Node(instance in=w10) -> ("Path"=w13, "Datatype"=w14)
          call "Open Tag.gvi"(path=w13, data type=w14, error in=w8, configuration=w5) -> (tag=w15, error out=w16)
          call "Read Tag (String).gvi"(tag in=w15, error in=w16) -> (value=w17, time stamp=w18, error out=w19)
          Is Greater(x=w18, y=w11) -> w20
          case (w20) {
            frame False, Default { }
            frame True {
              Property Node(instance in=w12, "ValueSignaling"=w17)
            }
          }
          append w18 to w4
        }
        for {
          w21 = each element of w7
          call "Close Tag (Single).gvi"(tag=w21, error in=w19) -> (error out=w22)
        }
        call "Close Configuration.gvi"(configuration=w5, error in=w22) -> (error out=w23)
        $"Error out Systemlink Read Cycle" <- w23
      }
    }
    next s1 = w4
    stop if $"Exit 2"
  }
  disable {
    frame Enabled { }
    frame Disabled {
      Destroy User Event()
    }
  }
  w24 = bool FALSE  # Stop Event
  Create User Event[EventName="Stop Event"](user event data type=w24) -> (error out=w25, user event out=w26)
  Register For Events("Stop Event"=w26) -> (event registration refnum out=w27)
  call "Create All Message Queues.gvi"(error in=w25) -> (message queues=w28, error out=w29)
  Property Node(instance in=w28) -> ("UI"=w30)
  s2 = w27  # shift register
  while {
    event (dynamic events = s2) {
      on "Exit" Value changed {
        call "Enqueue Message (Single).gvi"(priority message=TRUE, message queue in=w30, message="Exit") -> (message queue out=w33, error out=w32)
        w31 = default
      }
      on dynamic event 0 {
        $Display <- "\"Exit\" button pressed"
        w31 = TRUE
        w32 = default
        w33 = w30
      }
      on "Window" Close? {
        call "Enqueue Message (Single).gvi"(priority message=TRUE, message queue in=w30, message="Exit") -> (message queue out=w33)
        Event Filter("Discard?"=TRUE)
        w31 = default
        w32 = default
      }
      on "Initialize Software" Value changed {
        call "Enqueue Message (Single).gvi"(message queue in=w30, message="Initialize") -> (message queue out=w33, error out=w32)
        w31 = default
      }
      on "CMD Button" Value changed {
        call "Enqueue Message (Single).gvi"(message queue in=w30, message="Send CMD") -> (message queue out=w33, error out=w32)
        w31 = default
      }
      on "Panel Config Button" Value changed {
        call "Enqueue Message (Single).gvi"(message queue in=w30, message="Panel Config", message data=$"Panel Config Selector") -> (message queue out=w33, error out=w32)
        w31 = default
      }
      on "Panel Type Config Button" Value changed {
        call "Enqueue Message (Single).gvi"(message queue in=w30, message="Panel Type Switch", message data=$"Panel Type Config") -> (message queue out=w33, error out=w32)
        w31 = default
      }
      on "Load Type Config Button" Value changed {
        call "Enqueue Message (Single).gvi"(message queue in=w30, message="Load Type Switch", message data=$"Load Type Config") -> (message queue out=w33, error out=w32)
        w31 = default
      }
      on "MV-Panel Configuration" Value changed {
        Event Data() -> ("New Value"=w34)
        call "Enqueue Message (Single).gvi"(message queue in=w30, message="PV Config", message data=w34) -> (message queue out=w33, error out=w32)
        w31 = default
      }
      on "Heat Button" Value changed {
        call "Enqueue Message (Single).gvi"(message queue in=w30, message="Heat Config", message data=$"Heat Selector") -> (message queue out=w33, error out=w32)
        w31 = default
      }
      on "MV-Heating" Value changed {
        Event Data() -> ("New Value"=w35)
        call "Enqueue Message (Single).gvi"(message queue in=w30, message="Heat Config", message data=w35) -> (message queue out=w33, error out=w32)
        w31 = default
      }
      on "Set PV Angle Button" Value changed {
        call "Enqueue Message (Single).gvi"(message queue in=w30, message="Set PV Angle", message data=$"PV Angle") -> (message queue out=w33, error out=w32)
        w31 = default
      }
      on "MV-Panel Tilt Angle" Value changed {
        Event Data() -> ("New Value"=w36)
        Decimal String To Number(string=w36) -> (offset past number=w37)
        call "Enqueue Message (Single).gvi"(message queue in=w30, message="Set PV Angle", message data=w37) -> (message queue out=w33, error out=w32)
        w31 = default
      }
      on "IR Thermometer Position" Value changed {
        call "Enqueue Message (Single).gvi"(message queue in=w30, message="IR Thermometer Position", message data=$"IR Thermometer Position Selector") -> (message queue out=w33, error out=w32)
        w31 = default
      }
      on "Fans Button" Value changed {
        call "Enqueue Message (Single).gvi"(message queue in=w30, message="Fans Control", message data=$"Fans Selector") -> (message queue out=w33, error out=w32)
        w31 = default
      }
      on "Reset Button" Value changed {
        call "Enqueue Message (Single).gvi"(message queue in=w30, message="Reset") -> (message queue out=w33, error out=w32)
        w31 = default
      }
      on "MV-Cooling" Value changed {
        Event Data() -> ("New Value"=w38)
        call "Enqueue Message (Single).gvi"(message queue in=w30, message="Fans Control", message data=w38) -> (message queue out=w33, error out=w32)
        w31 = default
      }
      on "Brightness Config Button" Value changed {
        call "Enqueue Message (Single).gvi"(message queue in=w30, message="Brightness Config", message data=$"Light Power") -> (message queue out=w33, error out=w32)
        w31 = default
      }
      on "MV-Light Power" Value changed {
        Event Data() -> ("New Value"=w39)
        call "Enqueue Message (Single).gvi"(message queue in=w30, message="Brightness Config", message data=w39) -> (message queue out=w33, error out=w32)
        w31 = default
      }
      on "Optic Filter Config Button" Value changed {
        call "Enqueue Message (Single).gvi"(message queue in=w30, message="Optic Filter Config", message data=$"Optic Filter Selector") -> (message queue out=w33, error out=w32)
        w31 = default
      }
      on "MV-Optical Filter" Value changed {
        Event Data() -> ("New Value"=w40)
        call "Enqueue Message (Single).gvi"(message queue in=w30, message="Optic Filter Config", message data=w40) -> (message queue out=w33, error out=w32)
        w31 = default
      }
      on "Set LoadR" Value changed; "Set LoadRTotal" Value changed {
        Is Empty String Or Path(string/path=$"Set LoadRTotal") -> w41
        Concatenate Strings($LoadR1, $LoadR10, $LoadR100, $LoadR1000) -> w42
        Select(s=w41, t=w42, f=$"Set LoadRTotal") -> w43
        call "Enqueue Message (Single).gvi"(message queue in=w30, message="Set LoadR", message data=w43) -> (message queue out=w33, error out=w32)
        w31 = default
      }
      on "MV-LoadRTotal" Value changed {
        Event Data() -> ("New Value"=w44)
        call "Enqueue Message (Single).gvi"(message queue in=w30, message="Set LoadR", message data=w44) -> (message queue out=w33, error out=w32)
        w31 = default
      }
      on "No Load" Value changed {
        call "Enqueue Message (Single).gvi"(message queue in=w30, message="NoLoad") -> (message queue out=w33, error out=w32)
        w31 = default
      }
      on "VAC Button" Value changed {
        call "Enqueue Message (Single).gvi"(message queue in=w30, message="VAC", message data=0) -> (message queue out=w33, error out=w32)
        $"VAC Load Counter" <- 0
        w31 = default
      }
    }
    call "Error Handler - Event Handling Loop.gvi"(message queue in=w33, error in=w32) -> (dup error in=w45)
    stop if w31
  }
  # PV-panel type
  # PV-load type
  Unregister For Events(error in=w45, event registration refnum=s2)
  $"API Key" <- "zYUbuW0YNkg1G__lXfJiGVBNWME-HlVd2a5NUHp-IP"
  w46 = cluster{"VISA Resource": "VISA Instr"} {"VISA Resource"="COM5"}
  s3 = "UI Data.gtype" {all zero or empty}  # shift register
  s4 = w46  # shift register
  while {
    call "Dequeue Message.gvi"(message queue in=w30, error in=w29) -> (message queue out=w47, message=w48, message data=w49, error out=w50)
    $"Hardware Status" <- w48
    # s3: Data
    # s4: VISA
    # w26: Stop Event
    case (w48) ignore case {  # Message Cases
      frame "Initialize" {
        $"Arduino Status_2" <- FALSE
        Property Node(instance in=reference to "PV-Lab Status", "ValueSignaling"="Hardware Initializing")
        Flush Queue(error in=w50, queue=w47) -> (error out=w55, queue out=w56)
        call "Enqueue Message (Single).gvi"(message queue in=w56, message="Initialize VISA", error in=w55) -> (message queue out=w57, error out=w58)
        call "Enqueue Message (Single).gvi"(message queue in=w57, message="Set Arduino Status", error in=w58) -> (message queue out=w59, error out=w60)
        call "Enqueue Message (Single).gvi"(message queue in=w59, message="Panel Type Switch", message data="Panel Type 1", error in=w60) -> (message queue out=w61, error out=w62)
        call "Enqueue Message (Single).gvi"(message queue in=w61, message="Load Type Switch", message data="Panel Type 1", error in=w62) -> (message queue out=w63, error out=w64)
        call "Enqueue Message (Single).gvi"(message queue in=w63, message="NoLoad", error in=w64) -> (message queue out=w65, error out=w66)
        call "Enqueue Message (Single).gvi"(message queue in=w65, message="Brightness Config", message data=2, error in=w66) -> (message queue out=w67, error out=w68)
        call "Enqueue Message (Single).gvi"(message queue in=w67, message="Fans Control", message data="0", error in=w68) -> (message queue out=w69, error out=w70)
        call "Enqueue Message (Single).gvi"(message queue in=w69, message="Heat Config", message data="0", error in=w70) -> (message queue out=w71, error out=w72)
        call "Enqueue Message (Single).gvi"(message queue in=w71, message="Optic Filter Config", message data="No Filter", error in=w72) -> (message queue out=w73, error out=w74)
        call "Enqueue Message (Single).gvi"(message queue in=w73, message="IR Thermometer Position", message data="None", error in=w74) -> (message queue out=w75, error out=w76)
        call "Enqueue Message (Single).gvi"(message queue in=w75, message="Set PV Angle", message data=90, error in=w76) -> (message queue out=w77, error out=w78)
        call "Enqueue Message (Single).gvi"(message queue in=w77, message="Panel Config", message data="Parallel 4", error in=w78) -> (message queue out=w79, error out=w80)
        call "Enqueue Message (Single).gvi"(message queue in=w79, message="Wait For Event", error in=w80) -> (error out=w51)
        Build Array(reference to "Arduino Status") -> w81
        for {
          w82 = each element of w81
          Property Node(instance in=w82, "Value"="none")
        }
        Build Array(reference to "TempSensor", reference to "LuxSensor", reference to "Voltage 1", reference to "Current 1") -> w83
        for {
          w84 = each element of w83
          Property Node(instance in=w84, "Value"=-1)
        }
        $"TempSensor IR" <- -1
        Property Node(instance in=reference to "Set LoadRTotal", "Value"="")
        $Voltage220 <- -1
        Property Node(instance in=reference to "VAC Load Counter", "Value"=0)
        $"Load Reply" <- ""
        w52 = s3
        w53 = default
        w54 = s4
      }
      frame "Initialize VISA" {
        call "Configure Serial Port (Instr).gvi"(session in=$"Arduino COM Port", error in=w50, baud rate=115200) -> (session out=w85, error out=w86)
        call "Open (Instr).gvi"(resource name=w85, error in=w86) -> (session out=w87, error out=w51)
        Property Node(instance in=s4, "VISA Resource"=w87) -> (instance out=w54)
        Wait(time to wait=2000)
        w52 = s3
        w53 = default
      }
      frame "Initialize AI" {
        w51 = w50
        w52 = s3
        w53 = default
        w54 = default
      }
      frame "Wait For Event" {
        Wait(time to wait=100)
        call "Enqueue Message (Single).gvi"(message queue in=w47, message="Watchdog", error in=w50) -> (error out=w51)
        w52 = s3
        w53 = default
        w54 = s4
      }
      frame "Send CMD" {
        Property Node(instance in=s4) -> ("VISA Resource"=w88, instance out=w54)
        call "Enqueue Message (Single).gvi"(message queue in=w47, message="Wait For Event", error in=w50) -> (error out=w89)
        call "VISA WriteRead.gvi"(VISA_IN=w88, CMD=$"Manual Command to Arduino", ERROR_IN=w89) -> (Arduino_Reply=w90, ERROR_OUT=w51)
        Property Node(instance in=w90) -> (instance out=w91)
        $"Arduino Command Reply" <- w91
        w52 = s3
        w53 = default
      }
      frame "Set Arduino Status" {
        Property Node(instance in=s4) -> ("VISA Resource"=w92, instance out=w54)
        call "VISA WriteRead.gvi"(VISA_IN=w92, CMD="@TIME 10 CEPHEI#", ERROR_IN=w50) -> (ERROR_OUT=w51)
        w52 = s3
        w53 = default
      }
      frame "Reset" {
        call "Enqueue Message (Single).gvi"(message queue in=w47, message="Wait For Event", error in=w50) -> (error out=w93)
        Property Node(instance in=s4) -> ("VISA Resource"=w94, instance out=w54)
        call "VISA WriteRead.gvi"(VISA_IN=w94, CMD="@RESET 10 0#", ERROR_IN=w93) -> (ERROR_OUT=w51)
        w52 = s3
        w53 = default
      }
      frame "Watchdog" {
        Property Node(instance in=s4) -> ("VISA Resource"=w95, instance out=w54)
        call "VISA WriteRead.gvi"(VISA_IN=w95, CMD="@TIME 10 ?#", ERROR_IN=w50) -> (OUTPUT=w96, Arduino_Reply=w97, ERROR_OUT=w98)
        Property Node(instance in=w97) -> ("DATA"=w99)
        call "VISA Reply Parse.gvi"(string=w99) -> (Reply String=w100)
        Match Pattern(regular expression="CEPHEI", string=w100) -> (match substring=w101)
        Is Equal(x=w101, y="CEPHEI") -> w102
        case (w102) {
          frame False, Default {
            Wait(time to wait=5000)
            Property Node(instance in=reference to "PV-Lab Status", "ValueSignaling"="Hardware OFFLINE")
            Flush Queue(error in=w98, queue=w47) -> (error out=w103, queue out=w104)
            call "Enqueue Message (Single).gvi"(message queue in=w104, message="Initialize", error in=w103) -> (error out=w51)
          }
          frame True {
            # @OK TEMP_24.3750000000 LUX_0 IR_0 DIMMER_2 VOLT1_0.00 VOLTSNT1_-0.00 CURR1_-0.06 POWR1_0.00 VOLT2_0.00 VOLTSNT2_-0.00 CURR2_-0.06 POWR2_0.00
            Property Node(instance in=reference to "PV-Lab Status", "ValueSignaling"="Hardware ONLINE")
            call "VISA WriteRead.gvi"(VISA_IN=w96, CMD="@WDOG 10 1#", ERROR_IN=w98) -> (Arduino_Reply=w105, ERROR_OUT=w106)
            Property Node(instance in=w105) -> ("DATA"=w107)
            call "Enqueue Message (Single).gvi"(message queue in=w47, message="Wait For Event", error in=w106) -> (error out=w51)
            s5 = w107  # shift register
            while {
              Match Pattern(regular expression=" ", string=s5) -> (after substring=w108, before substring=w109)
              Match Pattern(regular expression="_", string=w109) -> (after substring=w110, before substring=w111)
              Floating Point String To Number(string=w110, use system decimal point (T)=FALSE) -> (number=w112)
              case (w111) {
                frame "", Default { }
                frame "TEMP" {
                  $TempSensor <- w112
                  Property Node(instance in=reference to "PV-Temperature, ºC", "Value"=w112)
                }
                frame "LUX" {
                  $LuxSensor <- w112
                  Property Node(instance in=reference to "PV-LightIntensity, W/m2", "Value"=w112)
                }
                frame "DIMMER" {
                  $Dimmer <- w112
                }
                frame "VOLT1" {
                  $"Voltage 1" <- w112
                  Property Node(instance in=reference to "PV-Voltage, V", "Value"=w112)
                }
                frame "VOLSNT1" {
                  $VOLTShunt1 <- w112
                }
                frame "CURR1" {
                  $"Current 1" <- w112
                  Property Node(instance in=reference to "PV-Current, mA", "Value"=w112)
                }
                frame "POWR1" {
                  $Power1 <- w112
                }
                frame "IR" {
                  Multiply(w112, 0.05) -> w113
                  $"TempSensor IR" <- w113
                }
                frame "GLOBALON" {
                  Is Greater(x=w112, y=900) -> w114
                  case (w114) {
                    frame False, Default {
                      $Voltage220 <- 0
                    }
                    frame True {
                      $Voltage220 <- 220
                    }
                  }
                }
              }
              Is Empty String Or Path(string/path=w108) -> w115
              next s5 = w108
              stop if w115
            }
            sequence {
              frame 0 {
                Property Node(instance in=$"Measured Data", "Voltage, V"=$"Voltage 1", "Current, mA"=$"Current 1", "Luminous Flux, Lux"=$LuxSensor, "Temperature, GradC"=$TempSensor, "Temperature IR, GradC"=0) -> (instance out=w116)
                $"Measured Data" <- w116
                $"Chart Volt" <- $"Voltage 1"
                $"Chart Current" <- $"Current 1"
                $"Chart Lux" <- $LuxSensor
                $"Chart Temperature" <- $TempSensor
                $"Chart Load" <- $"Set Load R"
              }
            }
          }
        }
        $"Arduino Status" <- w100
        $"Arduino Status_2" <- w102
        case ($Button) {
          frame False, Default { }
          frame True {
            $"Load Reply" <- ""
          }
        }
        w52 = s3
        w53 = default
      }
      frame "Panel Config" {
        Variant To Data(error in (no error)=w50, type=string "", variant=w49) -> (data=w117, error out=w118)
        Property Node(instance in=s4) -> ("VISA Resource"=w119, instance out=w54)
        call "Panel Switch.gvi"(VISA_IN=w119, CTRL="Disconnect", ERROR_IN=w118) -> (VISA_OUT=w120, ERROR_OUT=w121)
        case (w117) {
          frame "Single" {
            w124 = ["@DO 17 0#", "@DO 18 1#", "@DO 23 1#", "@DO 24 1#", "@DO 25 1#", "@DO 26 0#", "@DO 27 0#", "@DO 28 0#", "@DO 29 1#", "@DO 30 1#", "@DO 31 1#", "@DO 32 1#", "@DO 33 0#"]
            w125 = ["@DO 54 1#", "@DO 55 1#", "@DO 56 1#", "@DO 57 1#", "@DO 58 1#", "@DO 59 1#", "@DO 60 1#", "@DO 61 1#"]
            # @DO 17 0#
            # @DO 18 1#
            # @DO 23 1#
            # @DO 24 1#
            # @DO 25 1#
            # @DO 26 0#
            # @DO 27 0#
            # @DO 28 0#
            # @DO 29 1#
            # @DO 30 1#
            # @DO 31 1#
            # @DO 32 1#
            # @DO 33 0#
            #
            # 03,08,2020
            # 19:51
            Insert Into Array(inArray=w124, new=w125) -> w126
            call "VISA Multiple Write.gvi"(VISA_IN=w120, ARRAY_IN=w126, ERROR_IN=w121) -> (ERROR_OUT=w122)
            w123 = w117
          }
          frame "Parallel 2" {
            # @DO 17 1#
            # @DO 18 0#
            # @DO 23 1#
            # @DO 24 0#
            # @DO 25 1#
            # @DO 26 1#
            # @DO 27 1#
            # @DO 28 1#
            # @DO 29 1#
            # @DO 30 1#
            # @DO 31 1#
            # @DO 32 1#
            # @DO 33 1#
            #
            # 03.08.2020
            # 19.53
            w127 = ["@DO 17 1#", "@DO 18 0#", "@DO 23 1#", "@DO 24 0#", "@DO 25 1#", "@DO 26 1#", "@DO 27 1#", "@DO 28 1#", "@DO 29 1#", "@DO 30 1#", "@DO 31 1#", "@DO 32 1#", "@DO 33 1#"]
            # Disconnect all Diodes
            w128 = ["@DO 54 1#", "@DO 55 1#", "@DO 56 1#", "@DO 57 1#", "@DO 58 1#", "@DO 59 1#", "@DO 60 1#", "@DO 61 1#"]
            Insert Into Array(inArray=w127, new=w128) -> w129
            call "VISA Multiple Write.gvi"(VISA_IN=w120, ARRAY_IN=w129, ERROR_IN=w121) -> (ERROR_OUT=w122)
            w123 = w117
          }
          frame "Parallel 2 Diode" {
            # @DO 17 1#
            # @DO 18 0#
            # @DO 23 1#
            # @DO 24 0#
            # @DO 25 1#
            # @DO 26 1#
            # @DO 27 1#
            # @DO 28 1#
            # @DO 29 1#
            # @DO 30 1#
            # @DO 31 1#
            # @DO 32 1#
            # @DO 33 1#
            #
            # 03.08.2020
            # 19.54
            w130 = ["@DO 17 1#", "@DO 18 0#", "@DO 23 1#", "@DO 24 0#", "@DO 25 1#", "@DO 26 1#", "@DO 27 1#", "@DO 28 1#", "@DO 29 1#", "@DO 30 1#", "@DO 31 1#", "@DO 32 1#", "@DO 33 1#"]
            # @DO 56 0#
            # @DO 57 0#
            #
            # 19.54
            w131 = ["@DO 54 1#", "@DO 55 1#", "@DO 56 0#", "@DO 57 0#", "@DO 58 1#", "@DO 59 1#", "@DO 60 1#", "@DO 61 1#"]
            Insert Into Array(inArray=w130, new=w131) -> w132
            call "VISA Multiple Write.gvi"(VISA_IN=w120, ARRAY_IN=w132, ERROR_IN=w121) -> (ERROR_OUT=w122)
            w123 = w117
          }
          frame "Series 2" {
            # @DO 17 0#
            # @DO 18 1#
            # @DO 23 1#
            # @DO 24 0#
            # @DO 25 1#
            # @DO 26 1#
            # @DO 27 1#
            # @DO 28 1#
            # @DO 29 0#
            # @DO 30 1#
            # @DO 31 1#
            # @DO 32 0#
            # @DO 33 0#
            #
            # 03.08.2020
            # 19.55
            w133 = ["@DO 17 0#", "@DO 18 1#", "@DO 23 1#", "@DO 24 0#", "@DO 25 1#", "@DO 26 1#", "@DO 27 1#", "@DO 28 1#", "@DO 29 0#", "@DO 30 1#", "@DO 31 1#", "@DO 32 0#", "@DO 33 0#"]
            w134 = ["@DO 54 1#", "@DO 55 1#", "@DO 56 1#", "@DO 57 1#", "@DO 58 1#", "@DO 59 1#", "@DO 60 1#", "@DO 61 1#"]
            Insert Into Array(inArray=w133, new=w134) -> w135
            call "VISA Multiple Write.gvi"(VISA_IN=w120, ARRAY_IN=w135, ERROR_IN=w121) -> (ERROR_OUT=w122)
            w123 = w117
          }
          frame "Series 2 Diode" {
            # @DO 17 0#
            # @DO 18 1#
            # @DO 23 1#
            # @DO 24 0#
            # @DO 25 1#
            # @DO 26 1#
            # @DO 27 1#
            # @DO 28 1#
            # @DO 29 0#
            # @DO 30 1#
            # @DO 31 1#
            # @DO 32 0#
            # @DO 33 0#
            #
            # 03.08.2020
            # 19.57
            w136 = ["@DO 17 0#", "@DO 18 1#", "@DO 23 1#", "@DO 24 0#", "@DO 25 1#", "@DO 26 1#", "@DO 27 1#", "@DO 28 1#", "@DO 29 0#", "@DO 30 1#", "@DO 31 1#", "@DO 32 0#", "@DO 33 0#"]
            # @DO 60 0#
            # @DO 61 0#
            #
            # 03.08.2020
            w137 = ["@DO 54 1#", "@DO 55 1#", "@DO 56 1#", "@DO 57 1#", "@DO 58 1#", "@DO 59 1#", "@DO 60 0#", "@DO 61 0#"]
            Insert Into Array(inArray=w136, new=w137) -> w138
            call "VISA Multiple Write.gvi"(VISA_IN=w120, ARRAY_IN=w138, ERROR_IN=w121) -> (ERROR_OUT=w122)
            w123 = w117
          }
          frame "Parallel 4", Default {
            # @DO 17 1#
            # @DO 18 1#
            # @DO 23 1#
            # @DO 24 1#
            # @DO 25 1#
            # @DO 26 1#
            # @DO 27 1#
            # @DO 28 1#
            # @DO 29 1#
            # @DO 30 1#
            # @DO 31 1#
            # @DO 32 1#
            # @DO 33 1#
            #
            # 03.08.2020
            # 19.59
            w139 = ["@DO 17 1#", "@DO 18 1#", "@DO 23 1#", "@DO 24 1#", "@DO 25 1#", "@DO 26 1#", "@DO 27 1#", "@DO 28 1#", "@DO 29 1#", "@DO 30 1#", "@DO 31 1#", "@DO 32 1#", "@DO 33 1#"]
            w140 = ["@DO 54 1#", "@DO 55 1#", "@DO 56 1#", "@DO 57 1#", "@DO 58 1#", "@DO 59 1#", "@DO 60 1#", "@DO 61 1#"]
            Insert Into Array(inArray=w139, new=w140) -> w141
            call "VISA Multiple Write.gvi"(VISA_IN=w120, ARRAY_IN=w141, ERROR_IN=w121) -> (ERROR_OUT=w122)
            w123 = "Parallel 4"
          }
          frame "Parallel 4 Diode" {
            # @DO 17 1#
            # @DO 18 1#
            # @DO 23 1#
            # @DO 24 1#
            # @DO 25 1#
            # @DO 26 1#
            # @DO 27 1#
            # @DO 28 1#
            # @DO 29 1#
            # @DO 30 1#
            # @DO 31 1#
            # @DO 32 1#
            # @DO 33 1#
            # 03.08.2020
            # 20.00
            w142 = ["@DO 17 1#", "@DO 18 1#", "@DO 23 1#", "@DO 24 1#", "@DO 25 1#", "@DO 26 1#", "@DO 27 1#", "@DO 28 1#", "@DO 29 1#", "@DO 30 1#", "@DO 31 1#", "@DO 32 1#", "@DO 33 1#"]
            # @DO 54 0#
            # @DO 55 0#
            # @DO 56 0#
            # @DO 57 0#
            #
            # 03.08.2020
            # 20.00
            w143 = ["@DO 54 0#", "@DO 55 0#", "@DO 56 0#", "@DO 57 0#", "@DO 58 1#", "@DO 59 1#", "@DO 60 1#", "@DO 61 1#"]
            Insert Into Array(inArray=w142, new=w143) -> w144
            call "VISA Multiple Write.gvi"(VISA_IN=w120, ARRAY_IN=w144, ERROR_IN=w121) -> (ERROR_OUT=w122)
            w123 = w117
          }
          frame "Series 4" {
            # @DO 17 0#
            # @DO 18 1#
            # @DO 23 0#
            # @DO 24 1#
            # @DO 25 1#
            # @DO 26 0#
            # @DO 27 0#
            # @DO 28 0#
            # @DO 29 0#
            # @DO 30 0#
            # @DO 31 0#
            # @DO 32 0#
            # @DO 33 0#
            #
            # 03.08.2020
            # 20.02
            w145 = ["@DO 17 0#", "@DO 18 1#", "@DO 23 0#", "@DO 24 1#", "@DO 25 1#", "@DO 26 0#", "@DO 27 0#", "@DO 28 0#", "@DO 29 0#", "@DO 30 0#", "@DO 31 0#", "@DO 32 0#", "@DO 33 0#"]
            w146 = ["@DO 54 1#", "@DO 55 1#", "@DO 56 1#", "@DO 57 1#", "@DO 58 1#", "@DO 59 1#", "@DO 60 1#", "@DO 61 1#"]
            Insert Into Array(inArray=w145, new=w146) -> w147
            call "VISA Multiple Write.gvi"(VISA_IN=w120, ARRAY_IN=w147, ERROR_IN=w121) -> (ERROR_OUT=w122)
            w123 = w117
          }
          frame "Series 4 Diode" {
            # @DO 17 0#
            # @DO 18 1#
            # @DO 23 0#
            # @DO 24 1#
            # @DO 25 1#
            # @DO 26 0#
            # @DO 27 0#
            # @DO 28 0#
            # @DO 29 0#
            # @DO 30 0#
            # @DO 31 0#
            # @DO 32 0#
            # @DO 33 0#
            #
            # 03.08.2020
            # 20.03
            w148 = ["@DO 17 0#", "@DO 18 1#", "@DO 23 0#", "@DO 24 1#", "@DO 25 1#", "@DO 26 0#", "@DO 27 0#", "@DO 28 0#", "@DO 29 0#", "@DO 30 0#", "@DO 31 0#", "@DO 32 0#", "@DO 33 0#"]
            # @DO 58 0#
            # @DO 59 0#
            # @DO 60 0#
            # @DO 61 0#
            #
            # 03.08.2020
            # 20.04
            w149 = ["@DO 54 1#", "@DO 55 1#", "@DO 56 1#", "@DO 57 1#", "@DO 58 0#", "@DO 59 0#", "@DO 60 0#", "@DO 61 0#"]
            Insert Into Array(inArray=w148, new=w149) -> w150
            call "VISA Multiple Write.gvi"(VISA_IN=w120, ARRAY_IN=w150, ERROR_IN=w121) -> (ERROR_OUT=w122)
            w123 = w117
          }
          frame "Parallel Of Series" {
            # @DO 17 1#
            # @DO 18 1#
            # @DO 23 1#
            # @DO 24 1#
            # @DO 25 1#
            # @DO 26 1#
            # @DO 27 0#
            # @DO 28 1#
            # @DO 29 0#
            # @DO 30 0#
            # @DO 31 1#
            # @DO 32 0#
            # @DO 33 1#
            #
            # 03.08.2020
            # 20.05
            w151 = ["@DO 17 1#", "@DO 18 1#", "@DO 23 1#", "@DO 24 1#", "@DO 25 1#", "@DO 26 1#", "@DO 27 0#", "@DO 28 1#", "@DO 29 0#", "@DO 30 0#", "@DO 31 1#", "@DO 32 0#", "@DO 33 1#"]
            w152 = ["@DO 54 1#", "@DO 55 1#", "@DO 56 1#", "@DO 57 1#", "@DO 58 1#", "@DO 59 1#", "@DO 60 1#", "@DO 61 1#"]
            Insert Into Array(inArray=w151, new=w152) -> w153
            call "VISA Multiple Write.gvi"(VISA_IN=w120, ARRAY_IN=w153, ERROR_IN=w121) -> (ERROR_OUT=w122)
            w123 = w117
          }
          frame "Parallel Of Series Diode" {
            # @DO 17 1#
            # @DO 18 1#
            # @DO 23 1#
            # @DO 24 1#
            # @DO 25 1#
            # @DO 26 1#
            # @DO 27 0#
            # @DO 28 1#
            # @DO 29 0#
            # @DO 30 0#
            # @DO 31 1#
            # @DO 32 0#
            # @DO 33 1#
            #
            # 03.08.2020
            # 20.06
            # @DO 58 0#
            # @DO 59 0#
            # @DO 60 0#
            # @DO 61 0#
            #
            # 03.08.2020
            # 20.097
            w154 = ["@DO 17 1#", "@DO 18 1#", "@DO 23 1#", "@DO 24 1#", "@DO 25 1#", "@DO 26 1#", "@DO 27 0#", "@DO 28 1#", "@DO 29 0#", "@DO 30 0#", "@DO 31 1#", "@DO 32 0#", "@DO 33 1#"]
            w155 = ["@DO 54 1#", "@DO 55 1#", "@DO 56 1#", "@DO 57 1#", "@DO 58 0#", "@DO 59 0#", "@DO 60 0#", "@DO 61 0#"]
            Insert Into Array(inArray=w154, new=w155) -> w156
            call "VISA Multiple Write.gvi"(VISA_IN=w120, ARRAY_IN=w156, ERROR_IN=w121) -> (ERROR_OUT=w122)
            w123 = w117
          }
          frame "Series Of Parallel" {
            w157 = ["@DO 54 1#", "@DO 55 1#", "@DO 56 1#", "@DO 57 1#", "@DO 58 1#", "@DO 59 1#", "@DO 60 1#", "@DO 61 1#"]
            # @DO 17 1#
            # @DO 18 0#
            # @DO 23 0#
            # @DO 24 0#
            # @DO 25 0#
            # @DO 26 1#
            # @DO 27 1#
            # @DO 28 1#
            # @DO 29 1#
            # @DO 30 1#
            # @DO 31 1#
            # @DO 32 1#
            # @DO 33 1#
            #
            # 03.08.2020
            # 20.07
            w158 = ["@DO 17 1#", "@DO 18 0#", "@DO 23 0#", "@DO 24 0#", "@DO 25 0#", "@DO 26 1#", "@DO 27 1#", "@DO 28 1#", "@DO 29 1#", "@DO 30 1#", "@DO 31 1#", "@DO 32 1#", "@DO 33 1#"]
            Insert Into Array(inArray=w158, new=w157) -> w159
            call "VISA Multiple Write.gvi"(VISA_IN=w120, ARRAY_IN=w159, ERROR_IN=w121) -> (ERROR_OUT=w122)
            w123 = w117
          }
          frame "Series Of Parallel Diode" {
            # @DO 17 1#
            # @DO 18 0#
            # @DO 23 0#
            # @DO 24 0#
            # @DO 25 0#
            # @DO 26 1#
            # @DO 27 1#
            # @DO 28 1#
            # @DO 29 1#
            # @DO 30 1#
            # @DO 31 1#
            # @DO 32 1#
            # @DO 33 1#
            #
            # 03.08.2020
            # 20.08
            w160 = ["@DO 17 1#", "@DO 18 0#", "@DO 23 0#", "@DO 24 0#", "@DO 25 0#", "@DO 26 1#", "@DO 27 1#", "@DO 28 1#", "@DO 29 1#", "@DO 30 1#", "@DO 31 1#", "@DO 32 1#", "@DO 33 1#"]
            # @DO 54 0#
            # @DO 55 0#
            # @DO 56 0#
            # @DO 57 0#
            #
            # 20.09
            # 03.08.2020
            w161 = ["@DO 54 0#", "@DO 55 0#", "@DO 56 0#", "@DO 57 0#", "@DO 58 1#", "@DO 59 1#", "@DO 60 1#", "@DO 61 1#"]
            Insert Into Array(inArray=w160, new=w161) -> w162
            call "VISA Multiple Write.gvi"(VISA_IN=w120, ARRAY_IN=w162, ERROR_IN=w121) -> (ERROR_OUT=w122)
            w123 = w117
          }
        }
        Property Node(instance in=reference to "PV-Panel Cofiguration", "ValueSignaling"=w123)
        Property Node(instance in=reference to "Panel Config Selector", "Value"=w123)
        call "Panel Switch.gvi"(VISA_IN=w119, CTRL="Connect", ERROR_IN=w122) -> (ERROR_OUT=w51)
        w52 = s3
        w53 = default
      }
      frame "VAC" {
        w163 = ["0,", "1,", "2,", "3,", "5,", "5,3,", "10,", "20,", "20,10,", "40,", "50,", "50,10,", "50,20,", "50,20,10,", "50,40,", "100,", "100,10,", "100,20,", "100,20,10,", "100,40,", "100,50,10,", "100,50,20,10,", "200,", "200,20,", "200,40,", "200,50,10,", "200,50,20,10,", "200,100,", "200,100,20,5,", "200,100,50,", "200,100,50,20,5,", "400,", "400,20,5,", "400,50,", "500,", "500,50,", "500,100,", "500,100,50,", "500,200,", "500,200,100,", "500,400,", "1000,", "1000,200,", "1000,400,", "1000,500,100,", "1000,500,200,100,", "2000,", "2000,200,50,", "2000,500,", "2000,1000,", "2000,1000,500,", "4000,", "4000,500", "4000,1000,", "4000,2000,", "4000,2000,1000,", "4000,2000,1000,500,400,100,", "NO LOAD"]
        Variant To Data(type=$"VAC measurements", variant=w49) -> (data=w164)
        Array Size(array=w163) -> (size(s)=w165)
        Is Less Or Equal(x=$"VAC Load Counter", y=w165) -> w166
        Is Greater Or Equal(x=w164, y=$"VAC measurements") -> w167
        Not(x=$"VAC Pause") -> w168
        Logical And(w168, w167) -> w169
        Logical And(w169, w166) -> w170
        Not(x=$"VAC Stop") -> w171
        Logical And(w171, w166) -> w172
        case (w170) {
          frame False, Default {
            # Cycle Watchdog<->VAC until Load Array not completed
            case (w172) {
              frame False, Default {
                Flush Queue(error in=w50, queue=w47) -> (error out=w174, queue out=w175)
                # If Load Array completed NO LOAD and return to regular Watchdog
                call "Enqueue Message (Single).gvi"(message queue in=w175, message="NoLoad", error in=w174) -> (message queue out=w176, error out=w177)
                call "Enqueue Message (Single).gvi"(message queue in=w176, message="Watchdog", error in=w177) -> (error out=w51)
                Build Cluster($"VAC Volt", $"VAC Cur") -> w178
                $"I-V Curve (VAC)" <- w178
                $"VAC Stop" <- FALSE
                $"VAC Pause" <- FALSE
                w173 = 0
              }
              frame True {
                Flush Queue(error in=w50, queue=w47) -> (error out=w179, queue out=w180)
                call "Enqueue Message (Single).gvi"(message queue in=w180, message="Watchdog", error in=w179) -> (message queue out=w181, error out=w182)
                # If Load Array not completed cycle Watchdog<>VAC
                Increment(x=w164) -> w183
                call "Enqueue Message (Single).gvi"(message queue in=w181, message="VAC", message data=w183, error in=w182) -> (error out=w51)
                Build Array($"Voltage temp", $"Voltage 1") -> w184
                $"Voltage temp" <- w184
                Build Array($"Current array", $"Current 1") -> w185
                $"Current array" <- w185
                Build Array($"Total Load temp", $"Set Load R") -> w186
                $"Total Load temp" <- w186
                w173 = $"VAC Load Counter"
              }
            }
          }
          frame True {
            Array Index(array=w163) -> (out0[$"VAC Load Counter"]=w187)
            Flush Queue(error in=w50, queue=w47) -> (error out=w188, queue out=w189)
            # Set Load according to the Load Array
            Is Equal(x="NO LOAD", y=w187) -> w190
            case (w190) {
              frame True {
                call "Enqueue Message (Single).gvi"(message queue in=w189, message="NoLoad", error in=w188) -> (message queue out=w192, error out=w191)
              }
              frame False {
                call "Enqueue Message (Single).gvi"(message queue in=w189, message="Set LoadR", message data=w187, error in=w188) -> (message queue out=w192, error out=w191)
              }
            }
            call "Enqueue Message (Single).gvi"(message queue in=w192, message="VAC", message data=0, error in=w191) -> (error out=w51)
            Is Equal(x=$"VAC Load Counter", y=0) -> w193
            case (w193) {
              frame False, Default {
                sequence {
                  frame 0 {
                    call "Mean (DBL).gvi"(x=$"Voltage temp") -> (mean=w194)
                    Build Array($"VAC Volt", w194) -> w195
                    $"VAC Volt" <- w195
                    call "Mean (DBL).gvi"(x=$"Current array") -> (mean=w196)
                    Build Array($"VAC Cur", w196) -> w197
                    $"VAC Cur" <- w197
                    call "Mean (DBL).gvi"(x=$"Total Load temp") -> (mean=w198)
                    Build Array($"VAC Load", w198) -> w199
                    $"VAC Load" <- w199
                  }
                  frame 1 {
                    $"Voltage temp" <- f64[] []
                    $"Current array" <- f64[] []
                    $"Total Load temp" <- f64[] []
                  }
                }
              }
              frame True {
                $"VAC Volt" <- f64[] []
                $"VAC Load" <- f64[] []
                $"VAC Cur" <- f64[] []
                $"Voltage temp" <- f64[] []
                $"Current array" <- f64[] []
                $"Total Load temp" <- f64[] []
              }
            }
            Increment(x=$"VAC Load Counter") -> w173
          }
        }
        $"VAC Load Counter" <- w173
        w52 = s3
        w53 = default
        w54 = s4
      }
      frame "Optic Filter Config" {
        Variant To Data(error in (no error)=w50, type=string "", variant=w49) -> (data=w200, error out=w201)
        case (w200) {
          frame "No Filter", Default {
            w202 = ["@SERV 4 0#", "@SERVH 3 0#", "@SERV 5 0#"]
            w203 = "No Filter"
          }
          frame "Filter Glass" {
            w202 = ["@SERV 4 0#", "@SERV 5 0#", "@SERVH 3 120#"]
            w203 = w200
          }
          frame "Filter Plastic" {
            w202 = ["@SERV 4 0#", "@SERVH 3 0#", "@SERV 5 90#"]
            w203 = w200
          }
        }
        Property Node(instance in=reference to "Optic Filter Selector", "Value"=w203)
        Property Node(instance in=reference to "PV-Optical Filter", "ValueSignaling"=w203)
        Property Node(instance in=s4) -> ("VISA Resource"=w204, instance out=w54)
        call "VISA Multiple Write.gvi"(VISA_IN=w204, ARRAY_IN=w202, ERROR_IN=w201) -> (ERROR_OUT=w51)
        w52 = s3
        w53 = default
      }
      frame "Panel Type Switch" {
        Variant To Data(error in (no error)=w50, type=string "", variant=w49) -> (data=w205, error out=w206)
        case (w205) {
          frame "Panel Type 1", Default {
            w207 = ["@DO 50 1#", "@DO 51 1#"]
            w208 = "Panel type 1"
          }
          frame "Panel Type 2" {
            w207 = ["@DO 50 0#", "@DO 51 0#"]
            w208 = w205
          }
        }
        # PV-panel type
        Property Node(instance in=reference to "Panel Type Config", "Value"=w208)
        Property Node(instance in=s4) -> ("VISA Resource"=w209, instance out=w54)
        call "VISA Multiple Write.gvi"(VISA_IN=w209, ARRAY_IN=w207, ERROR_IN=w206) -> (ERROR_OUT=w51)
        w52 = s3
        w53 = default
      }
      frame "Load Type Switch" {
        Variant To Data(error in (no error)=w50, type=string "", variant=w49) -> (data=w210, error out=w211)
        case (w210) {
          frame "Panel Type 1", Default {
            w212 = ["@DO 52 1#", "@DO 53 1#"]
            w213 = "Load type 1"
          }
          frame "Load Type 2" {
            w212 = ["@DO 52 0#", "@DO 53 0#"]
            w213 = w210
          }
        }
        # PV-load type
        Property Node(instance in=reference to "Load Type Config", "Value"=w213)
        Property Node(instance in=s4) -> ("VISA Resource"=w214, instance out=w54)
        call "VISA Multiple Write.gvi"(VISA_IN=w214, ARRAY_IN=w212, ERROR_IN=w211) -> (ERROR_OUT=w51)
        w52 = s3
        w53 = default
      }
      frame "Fans Control" {
        Variant To Data(error in (no error)=w50, type=string "", variant=w49) -> (data=w215, error out=w216)
        case (w215) {
          frame "0", Default {
            w217 = ["@DO 11 0#", "@DO 12 0#"]
            w218 = "0"
          }
          frame "100" {
            w217 = ["@PWM 11 255#", "@PWM 12 255#"]
            w218 = "100"
          }
          frame "50" {
            w217 = ["@PWM 11 127#", "@PWM 12 127#"]
            w218 = "50"
          }
        }
        Property Node(instance in=reference to "PV-Cooling", "ValueSignaling"=w218)
        Property Node(instance in=reference to "Fans Selector", "Value"=w218)
        Property Node(instance in=s4) -> ("VISA Resource"=w219, instance out=w54)
        call "VISA Multiple Write.gvi"(VISA_IN=w219, ARRAY_IN=w217, ERROR_IN=w216) -> (ERROR_OUT=w51)
        w52 = s3
        w53 = default
      }
      frame "Heat Config" {
        Variant To Data(error in (no error)=w50, type=string "", variant=w49) -> (data=w220, error out=w221)
        case (w220) {
          frame "0", Default {
            w222 = ["@DO 9 0#"]
            w223 = "0"
            w224 = w221
          }
          frame "50" {
            call "Enqueue Message (Single).gvi"(message queue in=w47, message="Fans Control", message data="50", error in=w221) -> (error out=w224)
            w222 = ["@PWM 9 125#"]
            w223 = "50"
          }
          frame "25" {
            call "Enqueue Message (Single).gvi"(message queue in=w47, message="Fans Control", message data="50", error in=w221) -> (error out=w224)
            w222 = ["@PWM 9 65#"]
            w223 = "25"
          }
        }
        Property Node(instance in=reference to "PV-Heating", "ValueSignaling"=w223)
        Property Node(instance in=reference to "Heat Selector", "Value"=w223)
        Property Node(instance in=s4) -> ("VISA Resource"=w225, instance out=w54)
        call "VISA Multiple Write.gvi"(VISA_IN=w225, ARRAY_IN=w222, ERROR_IN=w224) -> (ERROR_OUT=w51)
        w52 = s3
        w53 = default
      }
      frame "Set PV Angle" {
        Variant To Data(error in (no error)=w50, type=u32 0, variant=w49) -> (data=w226, error out=w227)
        # Set angle limits for PV panels
        In Range And Coerce(lower limit=0, upper limit=180, x=w226) -> (coerced(x)=w228)
        Property Node(instance in=reference to "PV-Panel Tilt Angle, º", "ValueSignaling"=w228)
        Property Node(instance in=reference to "PV Angle", "Value"=w228)
        Property Node(instance in=s4) -> ("VISA Resource"=w229, instance out=w54)
        Number To Decimal String(number=w228) -> (decimal integer string=w230)
        Concatenate Strings("@SERV 13 ", w230, "#") -> w231
        call "VISA WriteRead.gvi"(VISA_IN=w229, CMD=w231, ERROR_IN=w227) -> (ERROR_OUT=w51)
        w52 = s3
        w53 = default
      }
      frame "Brightness Config" {
        Variant To Data(error in (no error)=w50, type=u32 0, variant=w49) -> (data=w232, error out=w233)
        # Set brightness limits
        In Range And Coerce(lower limit=2, upper limit=99, x=w232) -> (coerced(x)=w234)
        Property Node(instance in=reference to "Light Power", "Value"=w234)
        Property Node(instance in=s4) -> ("VISA Resource"=w235, instance out=w54)
        Number To Decimal String(number=w234) -> (decimal integer string=w236)
        Concatenate Strings("@DIM 6 ", w236, "#") -> w237
        call "VISA WriteRead.gvi"(VISA_IN=w235, CMD=w237, ERROR_IN=w233) -> (ERROR_OUT=w51)
        w52 = s3
        w53 = default
      }
      frame "IR Thermometer Position" {
        Variant To Data(error in (no error)=w50, type=string "", variant=w49) -> (data=w238, error out=w239)
        case (w238) {
          frame "None", Default {
            w240 = "@SERV 4 0#"
            w241 = w238
          }
          frame "Panel 1" {
            w240 = "@SERV 4 60#"
            w241 = w238
          }
          frame "Panel 2" {
            w240 = "@SERV 4 88#"
            w241 = w238
          }
          frame "Panel 3" {
            w240 = "@SERV 4 130#"
            w241 = w238
          }
          frame "Panel 4" {
            w240 = "@SERV 4 160#"
            w241 = w238
          }
        }
        Property Node(instance in=reference to "IR Thermometer Position Selector", "Value"=w241)
        Property Node(instance in=reference to "PV-Temperature IR Position", "ValueSignaling"=w241)
        Property Node(instance in=s4) -> ("VISA Resource"=w242, instance out=w54)
        call "VISA WriteRead.gvi"(VISA_IN=w242, CMD=w240, ERROR_IN=w239) -> (ERROR_OUT=w51)
        w52 = s3
        w53 = default
      }
      frame "Set LoadR" {
        Property Node(instance in=s4) -> ("VISA Resource"=w243, instance out=w54)
        Variant To Data(error in (no error)=w50, type=string "", variant=w49) -> (data=w244, error out=w245)
        # Disconnect ALL load
        w246 = ["@DO 14 1#", "@DO 34 0#", "@DO 35 0#", "@DO 36 0#", "@DO 37 0#", "@DO 38 0#", "@DO 39 0#", "@DO 40 0#", "@DO 41 0#", "@DO 43 0#", "@DO 44 0#", "@DO 45 0#", "@DO 46 0#", "@DO 47 0#", "@DO 48 0#", "@DO 49 0#", "@DO 42 0#"]
        sequence {
          frame 0 {
            call "VISA Multiple Write.gvi"(VISA_IN=w243, ARRAY_IN=w246, ERROR_IN=w245) -> (VISA_OUT=w247, ERROR_OUT=w248)
            $"Set Load R" <- 1
          }
        }
        s6 = w244  # shift register
        s7 = 0  # shift register
        s8 = ""  # shift register
        while {
          Match Pattern(regular expression=",", string=s6) -> (after substring=w249, before substring=w250)
          case (w250) {
            frame "1" {
              w251 = w250
              w252 = "@DO 43 1#"
            }
            frame "2" {
              w251 = w250
              w252 = "@DO 44 1#"
            }
            frame "3" {
              w251 = w250
              w252 = "@DO 45 1#"
            }
            frame "5" {
              w251 = w250
              w252 = "@DO 46 1#"
            }
            frame "10" {
              w251 = w250
              w252 = "@DO 47 1#"
            }
            frame "20" {
              w251 = w250
              w252 = "@DO 48 1#"
            }
            frame "40" {
              w251 = w250
              w252 = "@DO 49 1#"
            }
            frame "50" {
              w251 = w250
              w252 = "@DO 34 1#"
            }
            frame "100" {
              w251 = w250
              w252 = "@DO 35 1#"
            }
            frame "200" {
              w251 = w250
              w252 = "@DO 36 1#"
            }
            frame "400" {
              w251 = w250
              w252 = "@DO 37 1#"
            }
            frame "500" {
              w251 = w250
              w252 = "@DO 38 1#"
            }
            frame "1000" {
              w251 = w250
              w252 = "@DO 39 1#"
            }
            frame "2000" {
              w251 = w250
              w252 = "@DO 40 1#"
            }
            frame "4000" {
              w251 = w250
              w252 = "@DO 41 1#"
            }
            frame "6500" {
              w251 = w250
              w252 = "@DO 42 1#"
            }
            frame "0", Default {
              w251 = "0"
              w252 = ""
            }
          }
          Decimal String To Number(string=w251) -> (number=w253)
          Add(w253, s7) -> w254
          $"Set Load R" <- w254
          Concatenate Strings(s8, ",", w251) -> w255
          $"Total LoadR_SET" <- w255
          call "VISA WriteRead.gvi"(VISA_IN=w247, CMD=w252, ERROR_IN=w248) -> (Arduino_Reply=w256, ERROR_OUT=w257)
          Property Node(instance in=w256) -> ("Timestamp"=w258, "DATA"=w259)
          Format Date Time String(time format string (%c)="%c", time stamp=w258) -> (date/time string=w260)
          Concatenate Strings(w244, "-----", w260, "-----", w250, "-----", w252, "-----", w259, "\r") -> w261
          Feedback Node(input=w262) -> w263
          Concatenate Strings(w263, w261) -> w262
          $"Load Reply" <- w262
          Is Empty String Or Path(string/path=w249) -> w264
          next s6 = w249
          next s7 = w254
          next s8 = w255
          stop if w264
        }
        # Connect Load
        call "VISA WriteRead.gvi"(VISA_IN=w243, CMD="@DO 14 0#", ERROR_IN=w257) -> (ERROR_OUT=w51)
        sequence {
          frame 0 {
            Wait(time to wait=5000)
          }
        }
        $"Set Load R" <- s7
        Property Node(instance in=reference to "PV-LoadR,Ohm", "ValueSignaling"=s7)
        $"Total LoadR_SET" <- s8
        Property Node(instance in=reference to "PV-LoadRTotal", "ValueSignaling"=s8)
        w52 = s3
        w53 = default
      }
      frame "NoLoad" {
        # Сопротивление в начальное положение
        Property Node(instance in=reference to "PV-LoadRTotal", "ValueSignaling"="Disconnected (NO LOAD)")
        Property Node(instance in=reference to "Set LoadRTotal", "Value"="")
        $"Total LoadR_SET" <- "Disconnected (NO LOAD)"
        Property Node(instance in=reference to "PV-LoadR,Ohm", "ValueSignaling"=-1)
        Property Node(instance in=s4) -> ("VISA Resource"=w265, instance out=w54)
        # Disconnect all Load adn breake circuit
        # NO LOAD
        # Размыкаются всё реле, сопротивление- бесконечность
        w266 = ["@DO 42 1#", "@DO 34 1#", "@DO 35 1#", "@DO 36 1#", "@DO 37 1#", "@DO 38 1#", "@DO 39 1#", "@DO 40 1#", "@DO 41 1#", "@DO 43 1#", "@DO 44 1#", "@DO 45 1#", "@DO 46 1#", "@DO 47 1#", "@DO 48 1#", "@DO 49 1#"]
        call "VISA Multiple Write.gvi"(VISA_IN=w265, ARRAY_IN=w266, ERROR_IN=w50) -> (ERROR_OUT=w51)
        sequence {
          frame 0 {
            Wait(time to wait=7000)
          }
        }
        $"Set Load R" <- -1
        w52 = s3
        w53 = default
      }
      frame "Error" {
        Variant To Data(error in (no error)=w50, type=no error, variant=w49) -> (data=w267, error out=w51)
        # #CodeRecommended - If you ever change the name of this "Error" message, you'll need to update the name in the Check Loop Error.vi as well.
        call "Display Error.gvi"(error in=w267)
        w52 = s3
        w53 = default
        w54 = s4
      }
      frame "Exit" {
        Generate User Event(event data=TRUE, user event=w26) -> (error out=w268)
        Release Queue(error in=w50, queue=w47) -> (error out=w269)
        Property Node(instance in=s4) -> ("VISA Resource"=w270)
        call "Close (Instr).gvi"(session in=w270) -> (error out=w271)
        Merge Errors(w271, w268, w269) -> (error out=w51)
        w52 = s3
        w53 = TRUE
        w54 = default
      }
      frame Default {
        w272 = "The invalid message string \"%s\" was received in the Message Handling Loop."
        Format Into String(formatString=w272, w48) -> w273
        call "Build Error Cluster.gvi"(code=1, description=w273) -> (error out=w51)
        w52 = s3
        w53 = default
        w54 = s4
      }
    }
    call "Error Handler - Message Handling Loop.gvi"(message queue in=w47, error in=w51) -> (dup error in=w274)
    next s3 = w52
    next s4 = w54
    stop if w53
  }
  $"Server URL" <- "https://api.systemlinkcloud.com/"
  $"Exit 2" <- FALSE
  $SendArrayDoubleToCloud <- "Send Measured Data To Cloud"
  $SendStringToCloud <- "Send String To Cloud"
  $SendDoubleToCloud <- "Send Double To Cloud"
  w275 = bool FALSE  # Stop Event
  Create User Event[EventName="Stop Event"](user event data type=w275) -> (error out=w276, user event out=w277)
  call "Create All Message Queues.gvi"(error in=w276) -> (message queues=w278, error out=w279)
  Property Node(instance in=w278) -> ("UI"=w280)
  s9 = "UI Data.gtype" {all zero or empty}  # shift register
  while {
    call "Dequeue Message.gvi"(message queue in=w280, error in=w279) -> (message queue out=w281, message=w282, message data=w283, error out=w284)
    # s9: Data
    # w277: Stop Event
    case (w282) ignore case {  # Message Cases
      frame "Initialize" {
        Property Node(instance in=s9, "String"=w282) -> (instance out=w286)
        call "Enqueue Message (Single).gvi"(message queue in=w281, message="Update Display", message data=w282, error in=w284) -> (message queue out=w288, error out=w289)
        # Bundle a sample string value.
        call "Enqueue Message (Single).gvi"(message queue in=w288, message=$SendArrayDoubleToCloud, error in=w289) -> (error out=w285)
        Property Node(instance in=reference to "PV-Temperature, ºC", "ValueSignaling"=0)
        Property Node(instance in=reference to "MV-Panel Configuration", "Value"="none")
        Property Node(instance in=reference to "PV-Panel Cofiguration", "ValueSignaling"="none")
        Property Node(instance in=reference to "MV-Heating", "Value"="none")
        Property Node(instance in=reference to "PV-Temperature IR, ºC", "ValueSignaling"=0)
        Property Node(instance in=reference to "PV-Heating", "ValueSignaling"="none")
        Property Node(instance in=reference to "MV-Cooling", "Value"="none")
        Property Node(instance in=reference to "PV-LightIntensity, W/m2", "ValueSignaling"=0)
        Property Node(instance in=reference to "PV-Cooling", "ValueSignaling"="none")
        Property Node(instance in=reference to "MV-Light Power", "Value"="none")
        Property Node(instance in=reference to "PV-Panel Tilt Angle, º", "ValueSignaling"=0)
        Property Node(instance in=reference to "PV-Optical Filter", "ValueSignaling"="none")
        Property Node(instance in=reference to "MV-Optical Filter", "Value"="none")
        Property Node(instance in=reference to "PV-LigthPower, %", "ValueSignaling"=0)
        Property Node(instance in=reference to "PV-LoadR4", "ValueSignaling"="none")
        Property Node(instance in=reference to "MV-Panel Tilt Angle", "Value"="none")
        Property Node(instance in=reference to "PV-Voltage, V", "ValueSignaling"=0)
        Property Node(instance in=reference to "PV-LoadR3", "ValueSignaling"="none")
        Property Node(instance in=reference to "MV-LoadR1", "Value"="none")
        Property Node(instance in=reference to "PV-LoadR2", "ValueSignaling"="none")
        Property Node(instance in=reference to "PV-Current, mA", "ValueSignaling"=0)
        Property Node(instance in=reference to "MV-LoadR2", "Value"="none")
        Property Node(instance in=reference to "PV-LoadR1", "ValueSignaling"="none")
        Property Node(instance in=reference to "PV-LoadR,Ohm", "ValueSignaling"=0)
        Property Node(instance in=reference to "MV-LoadR3", "Value"="none")
        Property Node(instance in=reference to "PV-LoadRTotal", "ValueSignaling"="none")
        Property Node(instance in=reference to "MV-LoadR4", "Value"="none")
        Property Node(instance in=reference to "MV-LoadRTotal", "Value"="none")
        w287 = default
      }
      frame "Something" {
        # #CodeNeeded - Perform whatever actions correspond to the "Something" message.
        # Send string to "Update Display" message
        call "Enqueue Message (Single).gvi"(message queue in=w281, message="Update Display", message data="\"Do Something\" button pressed", error in=w284) -> (error out=w285)
        w286 = s9
        w287 = default
      }
      frame "Something Else" {
        # #CodeNeeded - Perform whatever actions correspond to the "Something Else" message.
        # Send string to "Update Display" message
        call "Enqueue Message (Single).gvi"(message queue in=w281, message="Update Display", message data="\"Do Something Else\" button pressed", error in=w284) -> (error out=w285)
        w286 = s9
        w287 = default
      }
      frame "Update Display" {
        # #CodeRecommended - If you wish to decouple the Message Handling Loop from your user interface, consider creating User Events (like the "Stop" event in this VI) to message the Event Handling Loop whenever the user interface needs updating.
        Variant To Data(error in (no error)=w284, type=string "", variant=w283) -> (data=w290, error out=w285)
        $"Status of Send to SystemLink Cycle" <- w290
        w286 = s9
        w287 = default
      }
      frame "Error" {
        Variant To Data(error in (no error)=w284, type=no error, variant=w283) -> (data=w291, error out=w285)
        # #CodeRecommended - Consider creating a system for logging errors in some way. These errors are for notification purposes only. Handling of specific errors should be performed in the message frames that generated the error.
        # #CodeRecommended - If you ever change the name of this "Error" message, you'll need to update the name in the Check Loop Error.vi as well.
        call "Display Error.gvi"(error in=w291)
        w286 = s9
        w287 = default
      }
      frame "---Copy This Frame---" {
        Merge Errors(w284) -> (error out=w285)
        w286 = s9
        w287 = default
      }
      frame "Exit" {
        # Release the message queue reference
        Release Queue(error in=w284, queue=w281) -> (error out=w292)
        # #CodeNeeded - Add any required cleanup code here. Note that if 'Exit' was called as a result of an error, an error dialog will be displayed. Add any custom error handling for an 'Exit' condition here as well.
        Generate User Event(event data=TRUE, user event=w277) -> (error out=w293)
        Merge Errors(w293, w292) -> (error out=w285)
        # Stop the VI
        $"Exit 2" <- TRUE
        w286 = s9
        w287 = TRUE
      }
      frame Default {
        w294 = "The invalid message string \"%s\" was received in the Message Handling Loop."
        Format Into String(formatString=w294, w282) -> w295
        call "Build Error Cluster.gvi"(code=1, description=w295) -> (error out=w285)
        w286 = s9
        w287 = default
      }
      frame "Send Double To Cloud" {
        Property Node(instance in=s9, "String"=w282) -> (instance out=w286)
        call "Open Configuration API Key.gvi"(server url=$"Server URL", api key=$"API Key", error in=w284) -> (configuration=w296)
        Variant To Data(type=string[] [], variant=w283) -> (data=w297)
        Array Index(array=w297) -> (out0[0]=w298, out1[1]=w299)
        Floating Point String To Number(string=w299) -> (number=w300)
        Build Array(w298) -> w301
        call "Query Tags.gvi"(paths=w301, configuration=w296) -> (tags=w302, error out=w303)
        Array Index(array=w302) -> (out0[_]=w304)
        Property Node(instance in=w304) -> ("Path"=w305, "Datatype"=w306)
        call "Open Tag.gvi"(path=w305, data type=w306, error in=w303, configuration=w296) -> (tag=w307, error out=w308)
        call "Write Tag (DBL).gvi"(tag in=w307, value=w300, error in=w308) -> (tag out=w309, error out=w310)
        call "Close Tag (Single).gvi"(tag=w309, error in=w310) -> (error out=w311)
        call "Close Configuration.gvi"(configuration=w296, error in=w311) -> (error out=w285)
        call "Enqueue Message (Single).gvi"(message queue in=w281, message="Update Display", message data=w282)
        w287 = default
      }
      frame "Send Measured Data To Cloud" {
        Property Node(instance in=s9, "String"=w282) -> (instance out=w286)
        call "Enqueue Message (Single).gvi"(message queue in=w281, message="Update Display", message data=w282, error in=w284) -> (message queue out=w312, error out=w313)
        call "Enqueue Message (Single).gvi"(message queue in=w312, message=$SendArrayDoubleToCloud, error in=w313) -> (error out=w314)
        call "Open Configuration API Key.gvi"(server url=$"Server URL", api key=$"API Key", error in=w314) -> (configuration=w315, error out=w316)
        w317 = ["PV-Current", "PV-Voltage", "PV-LigthtIntensity", "PV-Temperature"]
        call "Query Tags.gvi"(paths=w317, error in=w316, configuration=w315) -> (tags=w318, error out=w319)
        Property Node(instance in=$"Measured Data") -> ("Voltage, V"=w320, "Current, mA"=w321, "Luminous Flux, Lux"=w322, "Temperature, GradC"=w323)
        Build Array(w320, w321, w322, w323) -> w324
        for {
          w325 = each element of w318
          w326 = each element of w324
          Property Node(instance in=w325) -> ("Path"=w327, "Datatype"=w328)
          call "Open Tag.gvi"(path=w327, data type=w328, error in=w319, configuration=w315) -> (tag=w329, error out=w330)
          call "Write Tag (DBL).gvi"(tag in=w329, value=w326, error in=w330) -> (error out=w331)
        }
        for {
          w332 = each element of w318
          call "Close Tag (Single).gvi"(tag=w332, error in=w331) -> (error out=w333)
        }
        call "Close Configuration.gvi"(configuration=w315, error in=w333) -> (error out=w285)
        w287 = default
      }
      frame "Send String To Cloud" {
        Property Node(instance in=s9, "String"=w282) -> (instance out=w286)
        call "Open Configuration API Key.gvi"(server url=$"Server URL", api key=$"API Key", error in=w284) -> (configuration=w334, error out=w335)
        Variant To Data(type=string[] [], variant=w283) -> (data=w336)
        Array Index(array=w336) -> (out0[0]=w337, out1[1]=w338)
        Build Array(w337) -> w339
        call "Query Tags.gvi"(paths=w339, configuration=w334) -> (tags=w340)
        Array Index(array=w340) -> (out0[_]=w341)
        Property Node(instance in=w341) -> ("Path"=w342, "Datatype"=w343)
        call "Open Tag.gvi"(path=w342, data type=w343, error in=w335, configuration=w334) -> (tag=w344, error out=w345)
        call "Write Tag (String).gvi"(tag in=w344, value=w338, error in=w345) -> (tag out=w346, error out=w347)
        call "Close Tag (Single).gvi"(tag=w346, error in=w347) -> (error out=w348)
        call "Close Configuration.gvi"(configuration=w334, error in=w348) -> (error out=w285)
        call "Enqueue Message (Single).gvi"(message queue in=w281, message="Update Display", message data=w282)
        w287 = default
      }
    }
    call "Error Handler - Message Handling Loop.gvi"(message queue in=w281, error in=w285) -> (dup error in=w349)
    next s9 = w286
    stop if w287
  }
  Register For Events("Stop Event"=w277) -> (event registration refnum out=w350)
  s10 = w350  # shift register
  while {
    event (dynamic events = s10) {
      on "Do Something" Value changed {
        # #CodeNeeded - Send the appropriate message for this user interface event.
        call "Enqueue Message (Single).gvi"(message queue in=w280, message="Something") -> (message queue out=w353, error out=w352)
        w351 = default
      }
      on "Do Something Else" Value changed {
        # #CodeNeeded - Send the appropriate message for this user interface event.
        call "Enqueue Message (Single).gvi"(message queue in=w280, message="Something Else") -> (message queue out=w353, error out=w352)
        w351 = default
      }
      on "Exit" Value changed {
        call "Enqueue Message (Single).gvi"(priority message=TRUE, message queue in=w280, message="Exit") -> (message queue out=w353, error out=w352)
        w351 = default
      }
      on dynamic event 0 {
        # The Message Handling Loop processed an "Exit" message, which fired this event to stop the Event Handling Loop.
        $"Status of Send to SystemLink Cycle" <- "\"Exit\" button pressed"
        w351 = TRUE
        w352 = default
        w353 = w280
      }
      on "Window" Close? {
        call "Enqueue Message (Single).gvi"(priority message=TRUE, message queue in=w280, message="Exit") -> (message queue out=w353)
        Event Filter("Discard?"=TRUE)
        w351 = default
        w352 = default
      }
      on "PV-Current, mA" Value changed {
        Event Data() -> ("New Value"=w354)
        Number To Fractional String(number=w354) -> (F-format string=w355)
        Build Array("PV-Current", w355) -> w356
        call "Enqueue Message (Single).gvi"(message queue in=w280, message=$SendDoubleToCloud, message data=w356) -> (message queue out=w353, error out=w352)
        w351 = default
      }
      on "PV-LoadR,Ohm" Value changed {
        Event Data() -> ("New Value"=w357)
        Number To Fractional String(number=w357) -> (F-format string=w358)
        Build Array("PV-LoadR", w358) -> w359
        call "Enqueue Message (Single).gvi"(message queue in=w280, message=$SendDoubleToCloud, message data=w359) -> (message queue out=w353, error out=w352)
        w351 = default
      }
      on "PV-Voltage, V" Value changed {
        Event Data() -> ("New Value"=w360)
        Number To Fractional String(number=w360) -> (F-format string=w361)
        Build Array("PV-Voltage", w361) -> w362
        call "Enqueue Message (Single).gvi"(message queue in=w280, message=$SendDoubleToCloud, message data=w362) -> (message queue out=w353, error out=w352)
        w351 = default
      }
      on "PV-Temperature, ºC" Value changed {
        Event Data() -> ("New Value"=w363)
        Number To Fractional String(number=w363) -> (F-format string=w364)
        Build Array("PV-Temperature", w364) -> w365
        call "Enqueue Message (Single).gvi"(message queue in=w280, message=$SendDoubleToCloud, message data=w365) -> (message queue out=w353, error out=w352)
        w351 = default
      }
      on "PV-Temperature IR, ºC" Value changed {
        Event Data() -> ("New Value"=w366)
        Number To Fractional String(number=w366) -> (F-format string=w367)
        Build Array("PV-Temperature IR", w367) -> w368
        call "Enqueue Message (Single).gvi"(message queue in=w280, message=$SendDoubleToCloud, message data=w368) -> (message queue out=w353, error out=w352)
        w351 = default
      }
      on "PV-LightIntensity, W/m2" Value changed {
        Event Data() -> ("New Value"=w369)
        Number To Fractional String(number=w369) -> (F-format string=w370)
        Build Array("PV-LigthtIntensity", w370) -> w371
        call "Enqueue Message (Single).gvi"(message queue in=w280, message=$SendDoubleToCloud, message data=w371) -> (message queue out=w353, error out=w352)
        w351 = default
      }
      on "PV-LigthPower, %" Value changed {
        Event Data() -> ("New Value"=w372)
        Number To Fractional String(number=w372) -> (F-format string=w373)
        Build Array("PV-LigthtPower", w373) -> w374
        call "Enqueue Message (Single).gvi"(message queue in=w280, message=$SendDoubleToCloud, message data=w374) -> (message queue out=w353, error out=w352)
        w351 = default
      }
      on "PV-Panel Tilt Angle, º" Value changed {
        Event Data() -> ("New Value"=w375)
        Number To Fractional String(number=w375) -> (F-format string=w376)
        Build Array("PV-Panel Tilt Angle", w376) -> w377
        call "Enqueue Message (Single).gvi"(message queue in=w280, message=$SendDoubleToCloud, message data=w377) -> (message queue out=w353, error out=w352)
        w351 = default
      }
      on "PV-Panel Cofiguration" Value changed {
        Event Data() -> ("New Value"=w378)
        Build Array("PV-Panel Configuration", w378) -> w379
        call "Enqueue Message (Single).gvi"(message queue in=w280, message=$SendStringToCloud, message data=w379) -> (message queue out=w353, error out=w352)
        w351 = default
      }
      on "PV-Temperature IR Position" Value changed {
        Event Data() -> ("New Value"=w380)
        Build Array("PV-Temperature IR Position", w380) -> w381
        call "Enqueue Message (Single).gvi"(message queue in=w280, message=$SendStringToCloud, message data=w381) -> (message queue out=w353, error out=w352)
        w351 = default
      }
      on "PV-Cooling" Value changed {
        Event Data() -> ("New Value"=w382)
        Build Array("PV-Cooling", w382) -> w383
        call "Enqueue Message (Single).gvi"(message queue in=w280, message=$SendStringToCloud, message data=w383) -> (message queue out=w353, error out=w352)
        w351 = default
      }
      on "PV-Heating" Value changed {
        Event Data() -> ("New Value"=w384)
        Build Array("PV-Heating", w384) -> w385
        call "Enqueue Message (Single).gvi"(message queue in=w280, message=$SendStringToCloud, message data=w385) -> (message queue out=w353, error out=w352)
        w351 = default
      }
      on "PV-Optical Filter" Value changed {
        Event Data() -> ("New Value"=w386)
        Build Array("PV-Optical Filter", w386) -> w387
        call "Enqueue Message (Single).gvi"(message queue in=w280, message=$SendStringToCloud, message data=w387) -> (message queue out=w353, error out=w352)
        w351 = default
      }
      on "PV-LoadR1" Value changed {
        Event Data() -> ("New Value"=w388)
        Build Array("PV-LoadR1", w388) -> w389
        call "Enqueue Message (Single).gvi"(message queue in=w280, message=$SendStringToCloud, message data=w389) -> (message queue out=w353)
        w351 = default
        w352 = default
      }
      on "PV-LoadR2" Value changed {
        Event Data() -> ("New Value"=w390)
        Build Array("PV-LoadR2", w390) -> w391
        call "Enqueue Message (Single).gvi"(message queue in=w280, message=$SendStringToCloud, message data=w391) -> (message queue out=w353)
        w351 = default
        w352 = default
      }
      on "PV-LoadR3" Value changed {
        Event Data() -> ("New Value"=w392)
        Build Array("PV-LoadR3", w392) -> w393
        call "Enqueue Message (Single).gvi"(message queue in=w280, message=$SendStringToCloud, message data=w393) -> (message queue out=w353)
        w351 = default
        w352 = default
      }
      on "PV-LoadR4" Value changed {
        Event Data() -> ("New Value"=w394)
        Build Array("PV-LoadR4", w394) -> w395
        call "Enqueue Message (Single).gvi"(message queue in=w280, message=$SendStringToCloud, message data=w395) -> (message queue out=w353)
        w351 = default
        w352 = default
      }
      on "PV-LoadRTotal" Value changed {
        Event Data() -> ("New Value"=w396)
        Build Array("PV-LoadRTotal", w396) -> w397
        call "Enqueue Message (Single).gvi"(message queue in=w280, message=$SendStringToCloud, message data=w397) -> (message queue out=w353)
        w351 = default
        w352 = default
      }
      on "PV-Lab Status" Value changed {
        Event Data() -> ("New Value"=w398)
        Build Array("PV-LoadR4", w398) -> w399
        call "Enqueue Message (Single).gvi"(message queue in=w280, message=$SendStringToCloud, message data=w399) -> (message queue out=w353)
        w351 = default
        w352 = default
      }
    }
    call "Error Handler - Event Handling Loop.gvi"(message queue in=w353, error in=w352) -> (dup error in=w400)
    stop if w351
  }
  Unregister For Events(error in=w400, event registration refnum=s10) -> (error out=w401)
  Merge Errors(w401, w349) -> (error out=w402)
  Destroy User Event(error in=w402, user event=w277)
  disable {
    frame Enabled { }
    frame Disabled {
      call "Initialize.gvi"(device name="cam0") -> (session out=w403, error out=w404)
      call "Configure Grab.gvi"(session in=w403, error in=w404) -> (session out=w405, error out=w406)
      call "Create Image.gvi"(image name="image_1") -> (new image=w407)
      while {
        call "Grab.gvi"(session in=w405, error in=w406, image in=w407) -> (session out=w408, error out=w409)
        stop if _
      }
      call "Close.gvi"(session=w408, error in=w409)
    }
  }
