vi "Main.gvi"   [LabVIEW NXG 5.0.0]
# This template is for the Queued Message Handler design pattern.
# The Event Handling Loop generates messages based on user interface actions.
# The Message Handling Loop processes messages generated by the Event Handling Loop, or by other messages.  The messages are string values, so new messages can be added easily to the Message Cases case structure in the Message Handling Loop.  Each message cluster can also provide an optional value for Message Data, which is a variant that can be converted to whatever message-specific data is required.
panel controls:
  "Exit": bool
  "TEMP Button": bool
  "LUX Button": bool
  "VISA Resource Name": "VISA Instr" = "COM5"
  "Initialize VISA": bool
  "CMD Button": bool
  "Initialize AI": bool
  "PV Config Button": bool
  "Set PV Angle Button": bool
  "IR Thermometer Config Button": bool
  "Fans Button": bool
  "Brightness Config Button": bool
  "Optic Filter Config Button": bool
  "Reset CVM Button": bool
  "Stop": bool
  "PV Config Selector": string
  "PV Angle": i32
  "Fans Selector": string
  "Optic Filter Selector": string
  "IR Thermometer Selector": string
  "Brightness": i32
  "Prepare CVM Button": bool
  "write buffer": string = "@DO 34 0#"
  "Set Resistance Button": bool
  "Reset Resistance Button": bool
  "Resistance String": string
  "VAC Button": bool
  "Heat Selector": string
  "Heat Button": bool
  "Exit 2": bool
  "Do Something <Replace Me>": bool
  "Do Something Else <Replace Me>": bool
  "Exit_2": bool
  "PV-Current, mA": f64
  "PV-LoadR,Ohm": f64
  "PV-Voltage, V": f64
  "PV-Temperature, ºC": f64
  "PV-LightIntensity, W/m2": f64
  "PV-Panel Tilt Angle, º": f64
  "PV-Panel Cofiguration": string
  "PV-Cooling": string
  "PV-Heating": string
  "PV-Optical Filter": string
  "PV-LoadR1": string
  "PV-LoadR2": string
  "PV-LoadR3": string
  "PV-LoadR4": string
panel indicators:
  "Display": string
  "CMD": "TAG.gtype"
  "LUX_2": "TAG.gtype"
  "TEMP_2": "TAG.gtype"
  "Chart": waveform<f64>[]
  "Maсhine State": string
  "Voltage Range": f64
  "Voltage coeff": f64
  "Current coeff": f64
  "V_real": f64
  "Current_real": f64
  "VAC Load Counter": i32
  "Voltage_Graph": f64[]
  "Output": error
  "VISA Answer_2": "TAG.gtype"[]
  "VISA Answer": "TAG.gtype"[]
  "Current_Graph": f64[]
  "Graph_3": cluster{"Element 1": f64[], "Element 2": f64[]}
  "Server Url": string
  "Api Key": string
  "Status PV Config": string
  "PV-Connecting Solar Panels": string
  "CMD TIME": "TAG.gtype"
  "MV-Panel Configuration": string
  "MV-Cooling": string
  "MV-Heating": string
  "MV-Optical Filter": string
  "MV-Panel Tilt Angle": string
  "MV-Light Power": string
  "MV-LoadR1": string
  "MV-LoadR2": string
  "MV-LoadR3": string
  "MV-LoadR4": string
  "API Key_2": string
  "Server Url": string
  "Display <Replace Me>": string
  "SendDoubleToCloud": string
  "SendStringToCloud": string
  "error out": error
types:
  "TAG.gtype" = cluster{"Timestamp": timestamp, "DATA": string}
  "UI Data.gtype" = cluster{"Boolean <Replace Me>": bool, "String <Replace Me>": string, "Numeric <Replace Me>": f64}
  T1 = cluster{"VISA Resource": "VISA Instr", "Physical Channel": "DAQmx Task"}
  "ValueRange.gtype" = cluster{"maximum value": f64, "minimum value": f64}
uses:
  NI::Skyline::Configuration::Open Configuration API Key.gvi
  NI::Skyline::TagHTTP::Query Tags.gvi
  NI::Skyline::TagHTTP::Open Tag.gvi
  NI::Skyline::TagHTTP::Read Tag (String).gvi
  NI::Skyline::TagHTTP::Close Tag (Single).gvi
  NI::Skyline::Configuration::Close Configuration.gvi
  Message Queue::Create All Message Queues.gvi
  Message Queue::Enqueue Message (Single).gvi
  Support::Error Handler - Event Handling Loop.gvi
  Message Queue::Dequeue Message.gvi
  NI::VISA::Configure Serial Port (Instr).gvi
  NI::VISA::Open (Instr).gvi
  NI::DAQmx::Internal::DAQmx Create Channel (AI-Voltage-Basic).gvi
  Queued Message Handler::Read_Write_VISA.gvi
  Queued Message Handler::PV_switch.gvi
  Queued Message Handler::CMD_Iteration.gvi
  NI::DAQmx::Internal::DAQmx Read (Analog 2D DBL NChan NSamp).gvi
  NI::DAQmx::Internal::DAQmx Read (Analog 1D Wfm NChan NSamp).gvi
  NI::G Core::Error::Display Error.gvi
  NI::DAQmx::Internal::DAQmx Stop Task.gvi
  NI::VISA::Close (Instr).gvi
  NI::G Core::Error::Build Error Cluster.gvi
  Support::Error Handler - Message Handling Loop.gvi
  NI::Skyline::TagHTTP::Write Tag (DBL).gvi
  NI::Skyline::TagHTTP::Write Tag (String).gvi
  NI::Vision::IMAQdx::Initialize.gvi
  NI::Vision::IMAQdx::Configure Grab.gvi
  NI::Vision::Core::Basics::Create Image.gvi
  NI::Vision::IMAQdx::Grab.gvi
  NI::Vision::IMAQdx::Close.gvi
diagram:
  $"MV-Panel Configuration" <- ""
  $"MV-Cooling" <- ""
  $"MV-Heating" <- ""
  $"MV-Optical Filter" <- ""
  $"MV-Panel Tilt Angle" <- ""
  $"MV-Light Power" <- ""
  $"MV-LoadR1" <- ""
  $"MV-LoadR2" <- ""
  $"MV-LoadR3" <- ""
  $"MV-LoadR4" <- ""
  Array Size(array=["MV-Panels Configuration"]) -> (size(s)=w1)
  Initialize Array(element=1904-12-31T23:00:00Z, size=w1) -> w2
  sequence {
    frame 0 {
      Wait(time to wait=10000)
    }
  }
  s1 = w2  # shift register
  while {
    Wait(time to wait=500)
    call "Open Configuration API Key.gvi"(server url=$"Server Url", api key=$"API Key_2") -> (configuration=w3, error out=w4)
    call "Query Tags.gvi"(paths=["MV-Panels Configuration"], error in=w4, configuration=w3) -> (tags=w5, error out=w6)
    Build Array(reference to "MV-Panel Configuration", reference to "MV-Cooling", reference to "MV-Heating", reference to "MV-Optical Filter", reference to "MV-Panel Tilt Angle", reference to "MV-Light Power", reference to "MV-LoadR1", reference to "MV-LoadR2", reference to "MV-LoadR3", reference to "MV-LoadR4") -> w7
    for {
      w8 = each element of w5
      w9 = each element of s1
      w10 = each element of w7
      Property Node(instance in=w8) -> ("Path"=w12, "Datatype"=w13)
      call "Open Tag.gvi"(path=w12, data type=w13, error in=w6, configuration=w3) -> (tag=w14, error out=w15)
      call "Read Tag (String).gvi"(tag in=w14, error in=w15) -> (tag out=w16, value=w17, time stamp=w18, error out=w19)
      Is Greater(x=w18, y=w9) -> w20
      case (w20) {
        frame False, Default { }
        frame True {
          Property Node(instance in=w10, "ValueSignaling"=w17)
        }
      }
      append w18 to w11
    }
    call "Close Tag (Single).gvi"(tag=w16, error in=w19) -> (error out=w21)
    call "Close Configuration.gvi"(configuration=w3, error in=w21) -> (error out=w22)
    $"error out" <- w22
    next s1 = w11
    stop if $"Exit 2"
  }
  $"Server Url" <- "https://api.systemlinkcloud.com/"
  $"PV-Connecting Solar Panels" <- ""
  $"Api Key" <- "zYUbuW0YNkg1G__lXfJiGVBNWME-HlVd2a5NUHp-IP"
  disable {
    frame Enabled { }
    frame Disabled {
      Destroy User Event()
    }
  }
  w23 = bool FALSE  # Stop Event
  Create User Event[EventName="Stop Event"](user event data type=w23) -> (error out=w24, user event out=w25)
  Register For Events("Stop Event"=w25) -> (event registration refnum out=w26)
  call "Create All Message Queues.gvi"(error in=w24) -> (message queues=w27, error out=w28)
  Property Node(instance in=w27) -> ("UI"=w29)
  s2 = w26  # shift register
  while {
    event (dynamic events = s2) {
      on "TEMP Button" Value changed {
        call "Enqueue Message (Single).gvi"(message queue in=w29, message="Get Temperature") -> (message queue out=w32, error out=w31)
        w30 = default
      }
      on "LUX Button" Value changed {
        call "Enqueue Message (Single).gvi"(message queue in=w29, message="Get Brightness") -> (message queue out=w32, error out=w31)
        w30 = default
      }
      on "Exit" Value changed {
        call "Enqueue Message (Single).gvi"(priority message=TRUE, message queue in=w29, message="Exit") -> (message queue out=w32, error out=w31)
        w30 = default
      }
      on dynamic event 0 {
        $Display <- "\"Exit\" button pressed"
        w30 = TRUE
        w31 = default
        w32 = w29
      }
      on "Window" Close? {
        call "Enqueue Message (Single).gvi"(priority message=TRUE, message queue in=w29, message="Exit") -> (message queue out=w32)
        Event Filter("Discard?"=TRUE)
        w30 = default
        w31 = default
      }
      on "Initialize VISA" Value changed {
        call "Enqueue Message (Single).gvi"(message queue in=w29, message="Initialize VISA") -> (message queue out=w32, error out=w31)
        w30 = default
      }
      on "CMD Button" Value changed {
        call "Enqueue Message (Single).gvi"(message queue in=w29, message="Send CMD") -> (message queue out=w32, error out=w31)
        w30 = default
      }
      on "Reset CVM Button" Value changed {
        call "Enqueue Message (Single).gvi"(message queue in=w29, message="Reset CVM") -> (message queue out=w32, error out=w31)
        w30 = default
      }
      on "Initialize AI" Value changed {
        call "Enqueue Message (Single).gvi"(message queue in=w29, message="Initialize AI") -> (message queue out=w32, error out=w31)
        w30 = default
      }
      on "PV Config Button" Value changed {
        call "Enqueue Message (Single).gvi"(message queue in=w29, message="PV Config", message data=$"PV Config Selector") -> (message queue out=w32, error out=w31)
        w30 = default
      }
      on "MV-Panel Configuration" Value changed {
        call "Enqueue Message (Single).gvi"(message queue in=w29, message="PV Config", message data=$"MV-Panel Configuration") -> (message queue out=w32, error out=w31)
        w30 = default
      }
      on "Heat Button" Value changed {
        call "Enqueue Message (Single).gvi"(message queue in=w29, message="Heat Config", message data=$"Heat Selector") -> (message queue out=w32, error out=w31)
        w30 = default
      }
      on "Set PV Angle Button" Value changed {
        call "Enqueue Message (Single).gvi"(message queue in=w29, message="Set PV Angle", message data=$"PV Angle") -> (message queue out=w32, error out=w31)
        w30 = default
      }
      on "IR Thermometer Config Button" Value changed {
        call "Enqueue Message (Single).gvi"(message queue in=w29, message="IR Thermometer", message data=$"IR Thermometer Selector") -> (message queue out=w32, error out=w31)
        w30 = default
      }
      on "Fans Button" Value changed {
        call "Enqueue Message (Single).gvi"(message queue in=w29, message="Fans Control", message data=$"Fans Selector") -> (message queue out=w32, error out=w31)
        w30 = default
      }
      on "Brightness Config Button" Value changed {
        call "Enqueue Message (Single).gvi"(message queue in=w29, message="Brightness Config", message data=$Brightness) -> (message queue out=w32, error out=w31)
        w30 = default
      }
      on "Optic Filter Config Button" Value changed {
        call "Enqueue Message (Single).gvi"(message queue in=w29, message="Optic Filter Config", message data=$"Optic Filter Selector") -> (message queue out=w32, error out=w31)
        w30 = default
      }
      on "Prepare CVM Button" Value changed {
        call "Enqueue Message (Single).gvi"(message queue in=w29, message="Prepare CVM") -> (message queue out=w32, error out=w31)
        w30 = default
      }
      on "Set Resistance Button" Value changed {
        call "Enqueue Message (Single).gvi"(message queue in=w29, message="Set Resistance", message data=$"Resistance String") -> (message queue out=w32, error out=w31)
        w30 = default
      }
      on "Reset Resistance Button" Value changed {
        call "Enqueue Message (Single).gvi"(message queue in=w29, message="Reset Resistance") -> (message queue out=w32, error out=w31)
        w30 = default
      }
      on "VAC Button" Value changed {
        Property Node(instance in=reference to "Graph_3")
        Get Current Time() -> (current time=w33)
        call "Enqueue Message (Single).gvi"(message queue in=w29, message="VAC", message data=w33) -> (message queue out=w32)
        $"VAC Load Counter" <- 0
        w30 = default
        w31 = default
      }
    }
    call "Error Handler - Event Handling Loop.gvi"(message queue in=w32, error in=w31) -> (dup error in=w34)
    stop if w30
  }
  Unregister For Events(error in=w34, event registration refnum=s2)
  s3 = "UI Data.gtype" {all zero or empty}  # shift register
  s4 = T1 {"VISA Resource"="COM5", "Physical Channel"=""}  # shift register
  while {
    call "Dequeue Message.gvi"(message queue in=w29, error in=w28) -> (message queue out=w35, message=w36, message data=w37, error out=w38)
    $"Maсhine State" <- w36
    # s3: Data
    # w25: Stop Event
    case (w36) ignore case {  # Message Cases
      frame "Initialize" {
        # set time
        #
        # NO initialase SLC
        call "Enqueue Message (Single).gvi"(message queue in=w35, message="Initialize VISA", error in=w38) -> (message queue out=w43, error out=w44)
        call "Enqueue Message (Single).gvi"(message queue in=w43, message="Initialize AI", error in=w44) -> (message queue out=w45, error out=w46)
        call "Enqueue Message (Single).gvi"(message queue in=w45, message="Set Time", error in=w46) -> (message queue out=w47, error out=w48)
        call "Enqueue Message (Single).gvi"(message queue in=w47, message="Reset CVM", error in=w48) -> (message queue out=w49, error out=w50)
        call "Enqueue Message (Single).gvi"(message queue in=w49, message="Fans Control", message data="Turn All Off", error in=w50) -> (message queue out=w51, error out=w52)
        call "Enqueue Message (Single).gvi"(message queue in=w51, message="Heat Config", message data="No Heat", error in=w52) -> (message queue out=w53, error out=w54)
        call "Enqueue Message (Single).gvi"(message queue in=w53, message="Optic Filter Config", message data="None", error in=w54) -> (message queue out=w55, error out=w56)
        call "Enqueue Message (Single).gvi"(message queue in=w55, message="Set PV Angle", message data=90, error in=w56) -> (message queue out=w57, error out=w58)
        call "Enqueue Message (Single).gvi"(message queue in=w57, message="PV Config", message data="Parallel 4", error in=w58) -> (message queue out=w59, error out=w60)
        call "Enqueue Message (Single).gvi"(message queue in=w59, message="Wait For Event", error in=w60) -> (error out=w39)
        w40 = s3
        w41 = default
        w42 = s4
      }
      frame "Wait For Event" {
        call "Enqueue Message (Single).gvi"(message queue in=w35, message="Watchdog", error in=w38) -> (error out=w39)
        w40 = s3
        w41 = default
        w42 = s4
      }
      frame "Initialize VISA" {
        call "Configure Serial Port (Instr).gvi"(stop bits="1.0"(10), session in=$"VISA Resource Name", baud rate=115200, parity="None"(0), termination char=0xA, enable termination char=TRUE) -> (session out=w61, error out=w62)
        call "Open (Instr).gvi"(resource name=w61, error in=w62) -> (session out=w63, error out=w64)
        Property Node(instance in=s4, "VISA Resource"=w63) -> (instance out=w42)
        Wait(time to wait=2000)
        Merge Errors(w64, w38) -> (error out=w39)
        w40 = s3
        w41 = default
      }
      frame "Initialize AI" {
        call "DAQmx Create Channel (AI-Voltage-Basic).gvi"(physical channels="Dev1/ai0:1,Dev1/ai3,Dev1/ai7", units="Volts"(10348), measurement range="ValueRange.gtype" {"maximum value"=10, "minimum value"=0}, input terminal configuration="RSE"(10083)) -> (task out=w65, error out=w66)
        Property Node(instance in=s4, "Physical Channel"=w65) -> (instance out=w42)
        Merge Errors(w66, w38) -> (error out=w39)
        w40 = s3
        w41 = default
      }
      frame "Send CMD" {
        Property Node(instance in=s4) -> ("VISA Resource"=w67, instance out=w42)
        call "Read_Write_VISA.gvi"(VISA_IN=w67, CMD=$"write buffer", ERROR_IN=w38) -> (TAG=w68, ERROR_OUT=w69)
        $CMD <- w68
        call "Enqueue Message (Single).gvi"(message queue in=w35, message="Wait For Event", error in=w69) -> (error out=w39)
        w40 = s3
        w41 = default
      }
      frame "Set Time" {
        Property Node(instance in=s4) -> ("VISA Resource"=w70, instance out=w42)
        call "Read_Write_VISA.gvi"(VISA_IN=w70, CMD="@TIME 10 CEPHEI#", ERROR_IN=w38) -> (TAG=w71, ERROR_OUT=w72)
        $"CMD TIME" <- w71
        call "Enqueue Message (Single).gvi"(message queue in=w35, message="Wait For Event", error in=w72) -> (error out=w39)
        w40 = s3
        w41 = default
      }
      frame "PV Config" {
        Variant To Data(error in (no error)=w38, type=string "", variant=w37) -> (data=w73, error out=w74)
        Property Node(instance in=s4) -> ("VISA Resource"=w75, instance out=w42)
        call "PV_switch.gvi"(VISA_IN=w75, CTRL="Disconnect", ERROR_IN=w74) -> (VISA_OUT=w76, ERROR_OUT=w77)
        case (w73) {
          frame "Single" {
            w81 = ["@DO 17 0#", "@DO 18 1#", "@DO 23 1#", "@DO 24 1#", "@DO 25 1#", "@DO 26 0#", "@DO 27 0#", "@DO 28 0#", "@DO 29 1#", "@DO 30 1#", "@DO 31 1#", "@DO 32 1#", "@DO 33 0#"]
            w82 = ["@DO 54 1#", "@DO 55 1#", "@DO 56 1#", "@DO 57 1#", "@DO 58 1#", "@DO 59 1#", "@DO 60 1#", "@DO 61 1#"]
            # @DO 17 0#
            # @DO 18 1#
            # @DO 23 1#
            # @DO 24 1#
            # @DO 25 1#
            # @DO 26 0#
            # @DO 27 0#
            # @DO 28 0#
            # @DO 29 1#
            # @DO 30 1#
            # @DO 31 1#
            # @DO 32 1#
            # @DO 33 0#
            #
            # 03,08,2020
            # 19:51
            Insert Into Array(inArray=w81, new=w82) -> w83
            call "CMD_Iteration.gvi"(VISA_IN=w76, ARRAY_IN=w83, ERROR_IN=w77) -> (VISA Answer=w79, ERROR_OUT=w78)
            w80 = w73
          }
          frame "Parallel 2" {
            # @DO 17 1#
            # @DO 18 0#
            # @DO 23 1#
            # @DO 24 0#
            # @DO 25 1#
            # @DO 26 1#
            # @DO 27 1#
            # @DO 28 1#
            # @DO 29 1#
            # @DO 30 1#
            # @DO 31 1#
            # @DO 32 1#
            # @DO 33 1#
            #
            # 03.08.2020
            # 19.53
            w84 = ["@DO 17 1#", "@DO 18 0#", "@DO 23 1#", "@DO 24 0#", "@DO 25 1#", "@DO 26 1#", "@DO 27 1#", "@DO 28 1#", "@DO 29 1#", "@DO 30 1#", "@DO 31 1#", "@DO 32 1#", "@DO 33 1#"]
            # Disconnect all Diodes
            w85 = ["@DO 54 1#", "@DO 55 1#", "@DO 56 1#", "@DO 57 1#", "@DO 58 1#", "@DO 59 1#", "@DO 60 1#", "@DO 61 1#"]
            Insert Into Array(inArray=w84, new=w85) -> w86
            call "CMD_Iteration.gvi"(VISA_IN=w76, ARRAY_IN=w86, ERROR_IN=w77) -> (VISA Answer=w79, ERROR_OUT=w78)
            w80 = w73
          }
          frame "Parallel 2 Diode" {
            # @DO 17 1#
            # @DO 18 0#
            # @DO 23 1#
            # @DO 24 0#
            # @DO 25 1#
            # @DO 26 1#
            # @DO 27 1#
            # @DO 28 1#
            # @DO 29 1#
            # @DO 30 1#
            # @DO 31 1#
            # @DO 32 1#
            # @DO 33 1#
            #
            # 03.08.2020
            # 19.54
            w87 = ["@DO 17 1#", "@DO 18 0#", "@DO 23 1#", "@DO 24 0#", "@DO 25 1#", "@DO 26 1#", "@DO 27 1#", "@DO 28 1#", "@DO 29 1#", "@DO 30 1#", "@DO 31 1#", "@DO 32 1#", "@DO 33 1#"]
            # @DO 56 0#
            # @DO 57 0#
            #
            # 19.54
            w88 = ["@DO 54 1#", "@DO 55 1#", "@DO 56 0#", "@DO 57 0#", "@DO 58 1#", "@DO 59 1#", "@DO 60 1#", "@DO 61 1#"]
            Insert Into Array(inArray=w87, new=w88) -> w89
            call "CMD_Iteration.gvi"(VISA_IN=w76, ARRAY_IN=w89, ERROR_IN=w77) -> (VISA Answer=w79, ERROR_OUT=w78)
            w80 = w73
          }
          frame "Series 2" {
            # @DO 17 0#
            # @DO 18 1#
            # @DO 23 1#
            # @DO 24 0#
            # @DO 25 1#
            # @DO 26 1#
            # @DO 27 1#
            # @DO 28 1#
            # @DO 29 0#
            # @DO 30 1#
            # @DO 31 1#
            # @DO 32 0#
            # @DO 33 0#
            #
            # 03.08.2020
            # 19.55
            w90 = ["@DO 17 0#", "@DO 18 1#", "@DO 23 1#", "@DO 24 0#", "@DO 25 1#", "@DO 26 1#", "@DO 27 1#", "@DO 28 1#", "@DO 29 0#", "@DO 30 1#", "@DO 31 1#", "@DO 32 0#", "@DO 33 0#"]
            w91 = ["@DO 54 1#", "@DO 55 1#", "@DO 56 1#", "@DO 57 1#", "@DO 58 1#", "@DO 59 1#", "@DO 60 1#", "@DO 61 1#"]
            Insert Into Array(inArray=w90, new=w91) -> w92
            call "CMD_Iteration.gvi"(VISA_IN=w76, ARRAY_IN=w92, ERROR_IN=w77) -> (VISA Answer=w79, ERROR_OUT=w78)
            w80 = w73
          }
          frame "Series 2 Diode" {
            # @DO 17 0#
            # @DO 18 1#
            # @DO 23 1#
            # @DO 24 0#
            # @DO 25 1#
            # @DO 26 1#
            # @DO 27 1#
            # @DO 28 1#
            # @DO 29 0#
            # @DO 30 1#
            # @DO 31 1#
            # @DO 32 0#
            # @DO 33 0#
            #
            # 03.08.2020
            # 19.57
            w93 = ["@DO 17 0#", "@DO 18 1#", "@DO 23 1#", "@DO 24 0#", "@DO 25 1#", "@DO 26 1#", "@DO 27 1#", "@DO 28 1#", "@DO 29 0#", "@DO 30 1#", "@DO 31 1#", "@DO 32 0#", "@DO 33 0#"]
            # @DO 60 0#
            # @DO 61 0#
            #
            # 03.08.2020
            w94 = ["@DO 54 1#", "@DO 55 1#", "@DO 56 1#", "@DO 57 1#", "@DO 58 1#", "@DO 59 1#", "@DO 60 0#", "@DO 61 0#"]
            Insert Into Array(inArray=w93, new=w94) -> w95
            call "CMD_Iteration.gvi"(VISA_IN=w76, ARRAY_IN=w95, ERROR_IN=w77) -> (VISA Answer=w79, ERROR_OUT=w78)
            w80 = w73
          }
          frame "Parallel 4", Default {
            # @DO 17 1#
            # @DO 18 1#
            # @DO 23 1#
            # @DO 24 1#
            # @DO 25 1#
            # @DO 26 1#
            # @DO 27 1#
            # @DO 28 1#
            # @DO 29 1#
            # @DO 30 1#
            # @DO 31 1#
            # @DO 32 1#
            # @DO 33 1#
            #
            # 03.08.2020
            # 19.59
            w96 = ["@DO 17 1#", "@DO 18 1#", "@DO 23 1#", "@DO 24 1#", "@DO 25 1#", "@DO 26 1#", "@DO 27 1#", "@DO 28 1#", "@DO 29 1#", "@DO 30 1#", "@DO 31 1#", "@DO 32 1#", "@DO 33 1#"]
            w97 = ["@DO 54 1#", "@DO 55 1#", "@DO 56 1#", "@DO 57 1#", "@DO 58 1#", "@DO 59 1#", "@DO 60 1#", "@DO 61 1#"]
            Insert Into Array(inArray=w96, new=w97) -> w98
            call "CMD_Iteration.gvi"(VISA_IN=w76, ARRAY_IN=w98, ERROR_IN=w77) -> (VISA Answer=w79, ERROR_OUT=w78)
            w80 = w73
          }
          frame "Parallel 4 Diode" {
            # @DO 17 1#
            # @DO 18 1#
            # @DO 23 1#
            # @DO 24 1#
            # @DO 25 1#
            # @DO 26 1#
            # @DO 27 1#
            # @DO 28 1#
            # @DO 29 1#
            # @DO 30 1#
            # @DO 31 1#
            # @DO 32 1#
            # @DO 33 1#
            # 03.08.2020
            # 20.00
            w99 = ["@DO 17 1#", "@DO 18 1#", "@DO 23 1#", "@DO 24 1#", "@DO 25 1#", "@DO 26 1#", "@DO 27 1#", "@DO 28 1#", "@DO 29 1#", "@DO 30 1#", "@DO 31 1#", "@DO 32 1#", "@DO 33 1#"]
            # @DO 54 0#
            # @DO 55 0#
            # @DO 56 0#
            # @DO 57 0#
            #
            # 03.08.2020
            # 20.00
            w100 = ["@DO 54 0#", "@DO 55 0#", "@DO 56 0#", "@DO 57 0#", "@DO 58 1#", "@DO 59 1#", "@DO 60 1#", "@DO 61 1#"]
            Insert Into Array(inArray=w99, new=w100) -> w101
            call "CMD_Iteration.gvi"(VISA_IN=w76, ARRAY_IN=w101, ERROR_IN=w77) -> (VISA Answer=w79, ERROR_OUT=w78)
            w80 = w73
          }
          frame "Series 4" {
            # @DO 17 0#
            # @DO 18 1#
            # @DO 23 0#
            # @DO 24 1#
            # @DO 25 1#
            # @DO 26 0#
            # @DO 27 0#
            # @DO 28 0#
            # @DO 29 0#
            # @DO 30 0#
            # @DO 31 0#
            # @DO 32 0#
            # @DO 33 0#
            #
            # 03.08.2020
            # 20.02
            w102 = ["@DO 17 0#", "@DO 18 1#", "@DO 23 0#", "@DO 24 1#", "@DO 25 1#", "@DO 26 0#", "@DO 27 0#", "@DO 28 0#", "@DO 29 0#", "@DO 30 0#", "@DO 31 0#", "@DO 32 0#", "@DO 33 0#"]
            w103 = ["@DO 54 1#", "@DO 55 1#", "@DO 56 1#", "@DO 57 1#", "@DO 58 1#", "@DO 59 1#", "@DO 60 1#", "@DO 61 1#"]
            Insert Into Array(inArray=w102, new=w103) -> w104
            call "CMD_Iteration.gvi"(VISA_IN=w76, ARRAY_IN=w104, ERROR_IN=w77) -> (VISA Answer=w79, ERROR_OUT=w78)
            w80 = w73
          }
          frame "Series 4 Diode" {
            # @DO 17 0#
            # @DO 18 1#
            # @DO 23 0#
            # @DO 24 1#
            # @DO 25 1#
            # @DO 26 0#
            # @DO 27 0#
            # @DO 28 0#
            # @DO 29 0#
            # @DO 30 0#
            # @DO 31 0#
            # @DO 32 0#
            # @DO 33 0#
            #
            # 03.08.2020
            # 20.03
            w105 = ["@DO 17 0#", "@DO 18 1#", "@DO 23 0#", "@DO 24 1#", "@DO 25 1#", "@DO 26 0#", "@DO 27 0#", "@DO 28 0#", "@DO 29 0#", "@DO 30 0#", "@DO 31 0#", "@DO 32 0#", "@DO 33 0#"]
            # @DO 58 0#
            # @DO 59 0#
            # @DO 60 0#
            # @DO 61 0#
            #
            # 03.08.2020
            # 20.04
            w106 = ["@DO 54 1#", "@DO 55 1#", "@DO 56 1#", "@DO 57 1#", "@DO 58 0#", "@DO 59 0#", "@DO 60 0#", "@DO 61 0#"]
            Insert Into Array(inArray=w105, new=w106) -> w107
            call "CMD_Iteration.gvi"(VISA_IN=w76, ARRAY_IN=w107, ERROR_IN=w77) -> (VISA Answer=w79, ERROR_OUT=w78)
            w80 = w73
          }
          frame "Parallel Of Series" {
            # @DO 17 1#
            # @DO 18 1#
            # @DO 23 1#
            # @DO 24 1#
            # @DO 25 1#
            # @DO 26 1#
            # @DO 27 0#
            # @DO 28 1#
            # @DO 29 0#
            # @DO 30 0#
            # @DO 31 1#
            # @DO 32 0#
            # @DO 33 1#
            #
            # 03.08.2020
            # 20.05
            w108 = ["@DO 17 1#", "@DO 18 1#", "@DO 23 1#", "@DO 24 1#", "@DO 25 1#", "@DO 26 1#", "@DO 27 0#", "@DO 28 1#", "@DO 29 0#", "@DO 30 0#", "@DO 31 1#", "@DO 32 0#", "@DO 33 1#"]
            w109 = ["@DO 54 1#", "@DO 55 1#", "@DO 56 1#", "@DO 57 1#", "@DO 58 1#", "@DO 59 1#", "@DO 60 1#", "@DO 61 1#"]
            Insert Into Array(inArray=w108, new=w109) -> w110
            call "CMD_Iteration.gvi"(VISA_IN=w76, ARRAY_IN=w110, ERROR_IN=w77) -> (VISA Answer=w79, ERROR_OUT=w78)
            w80 = w73
          }
          frame "Parallel Of Series Diode" {
            # @DO 17 1#
            # @DO 18 1#
            # @DO 23 1#
            # @DO 24 1#
            # @DO 25 1#
            # @DO 26 1#
            # @DO 27 0#
            # @DO 28 1#
            # @DO 29 0#
            # @DO 30 0#
            # @DO 31 1#
            # @DO 32 0#
            # @DO 33 1#
            #
            # 03.08.2020
            # 20.06
            # @DO 58 0#
            # @DO 59 0#
            # @DO 60 0#
            # @DO 61 0#
            #
            # 03.08.2020
            # 20.097
            w111 = ["@DO 17 1#", "@DO 18 1#", "@DO 23 1#", "@DO 24 1#", "@DO 25 1#", "@DO 26 1#", "@DO 27 0#", "@DO 28 1#", "@DO 29 0#", "@DO 30 0#", "@DO 31 1#", "@DO 32 0#", "@DO 33 1#"]
            w112 = ["@DO 54 1#", "@DO 55 1#", "@DO 56 1#", "@DO 57 1#", "@DO 58 0#", "@DO 59 0#", "@DO 60 0#", "@DO 61 0#"]
            Insert Into Array(inArray=w111, new=w112) -> w113
            call "CMD_Iteration.gvi"(VISA_IN=w76, ARRAY_IN=w113, ERROR_IN=w77) -> (VISA Answer=w79, ERROR_OUT=w78)
            w80 = w73
          }
          frame "Series Of Parallel" {
            w114 = ["@DO 54 1#", "@DO 55 1#", "@DO 56 1#", "@DO 57 1#", "@DO 58 1#", "@DO 59 1#", "@DO 60 1#", "@DO 61 1#"]
            # @DO 17 1#
            # @DO 18 0#
            # @DO 23 0#
            # @DO 24 0#
            # @DO 25 0#
            # @DO 26 1#
            # @DO 27 1#
            # @DO 28 1#
            # @DO 29 1#
            # @DO 30 1#
            # @DO 31 1#
            # @DO 32 1#
            # @DO 33 1#
            #
            # 03.08.2020
            # 20.07
            w115 = ["@DO 17 1#", "@DO 18 0#", "@DO 23 0#", "@DO 24 0#", "@DO 25 0#", "@DO 26 1#", "@DO 27 1#", "@DO 28 1#", "@DO 29 1#", "@DO 30 1#", "@DO 31 1#", "@DO 32 1#", "@DO 33 1#"]
            Insert Into Array(inArray=w115, new=w114) -> w116
            call "CMD_Iteration.gvi"(VISA_IN=w76, ARRAY_IN=w116, ERROR_IN=w77) -> (VISA Answer=w79, ERROR_OUT=w78)
            w80 = w73
          }
          frame "Series Of Parallel Diode" {
            # @DO 17 1#
            # @DO 18 0#
            # @DO 23 0#
            # @DO 24 0#
            # @DO 25 0#
            # @DO 26 1#
            # @DO 27 1#
            # @DO 28 1#
            # @DO 29 1#
            # @DO 30 1#
            # @DO 31 1#
            # @DO 32 1#
            # @DO 33 1#
            #
            # 03.08.2020
            # 20.08
            w117 = ["@DO 17 1#", "@DO 18 0#", "@DO 23 0#", "@DO 24 0#", "@DO 25 0#", "@DO 26 1#", "@DO 27 1#", "@DO 28 1#", "@DO 29 1#", "@DO 30 1#", "@DO 31 1#", "@DO 32 1#", "@DO 33 1#"]
            # @DO 54 0#
            # @DO 55 0#
            # @DO 56 0#
            # @DO 57 0#
            #
            # 20.09
            # 03.08.2020
            w118 = ["@DO 54 0#", "@DO 55 0#", "@DO 56 0#", "@DO 57 0#", "@DO 58 1#", "@DO 59 1#", "@DO 60 1#", "@DO 61 1#"]
            Insert Into Array(inArray=w117, new=w118) -> w119
            call "CMD_Iteration.gvi"(VISA_IN=w76, ARRAY_IN=w119, ERROR_IN=w77) -> (VISA Answer=w79, ERROR_OUT=w78)
            w80 = w73
          }
        }
        call "PV_switch.gvi"(VISA_IN=w75, CTRL="Connect", ERROR_IN=w78) -> (ERROR_OUT=w39)
        case (w39) {
          frame Error, Default { }
          frame No Error {
            $"Status PV Config" <- w80
            Property Node(instance in=reference to "PV-Panel Cofiguration", "ValueSignaling"=w80)
          }
        }
        $"VISA Answer" <- w79
        w40 = s3
        w41 = default
      }
      frame "Reset CVM" {
        Property Node(instance in=s4) -> ("VISA Resource"=w120, instance out=w42)
        # VOLTAGE RANGE
        # @DO 51 0#
        # @DO 52 0#
        # @DO 53 0#
        # CURRENT RANGE
        # @DO 50 1#
        call "CMD_Iteration.gvi"(VISA_IN=w120, ARRAY_IN=["@DO 51 1#", "@DO 52 1#", "@DO 53 1#"], ERROR_IN=w38) -> (VISA_OUT=w121, ERROR_OUT=w122)
        call "CMD_Iteration.gvi"(VISA_IN=w121, ARRAY_IN=["@DO 50 1#"], ERROR_IN=w122) -> (ERROR_OUT=w39)
        $"Voltage coeff" <- 1
        $"Current coeff" <- 1
        w40 = s3
        w41 = default
      }
      frame "VAC" {
        w123 = ["0", "1,", "10,", "20,10,", "50,", "50,20,", "100,", "100,40,10,", "200,100,", "500,100,", "1000,", "2000,", "2000,1000,", "4000,", "4000,1000,", "4000,2000,", "4000,2000,1000,", "4000,2000,1000,500,400,100,"]
        Array Size(array=w123) -> (size(s)=w124)
        Is Less Or Equal(x=$"VAC Load Counter", y=w124) -> w125
        Property Node(instance in=s4) -> ("VISA Resource"=w126, "Physical Channel"=w127, instance out=w42)
        Variant To Data(type=timestamp 1904-01-01T00:00:00Z, variant=w37) -> (data=w128)
        Get Current Time() -> (current time=w129)
        Timestamp Subtract(x=w129, y=w128) -> w130
        Is Greater Or Equal(x=w130, y=5) -> w131
        Logical And(w131, w125) -> w132
        call "DAQmx Read (Analog 2D DBL NChan NSamp).gvi"(task in=w127, number of samples per channel=1) -> (data=w133)
        Array Index(array=w133) -> (out0[1, 0]=w134)
        Multiply(w134, 4) -> w135
        Feedback Node(input=w136) -> w137
        Build Array(w137, w135) -> w136
        Array Index(array=w133) -> (out0[0, 0]=w138)
        Divide(x=w138, y=70) -> w139
        Multiply(w139, 1000) -> w140
        Feedback Node(input=w141) -> w142
        Build Array(w142, w140) -> w141
        Build Cluster(w136, w141) -> w143
        case (w132) {
          frame False, Default {
            w144 = w38
            w145 = w128
            w146 = $"VAC Load Counter"
          }
          frame True {
            Get Current Time() -> (current time=w145)
            # Disconnect ALL load
            Array Index(array=w123) -> (out0[$"VAC Load Counter"]=w147)
            w148 = ["@DO 42 1#", "@DO 34 0#", "@DO 35 0#", "@DO 36 0#", "@DO 37 0#", "@DO 38 0#", "@DO 39 0#", "@DO 40 0#", "@DO 41 0#", "@DO 43 0#", "@DO 44 0#", "@DO 45 0#", "@DO 46 0#", "@DO 47 0#", "@DO 48 0#", "@DO 49 0#"]
            call "CMD_Iteration.gvi"(VISA_IN=w126, ARRAY_IN=w148, ERROR_IN=w38) -> (ERROR_OUT=w149)
            s5 = w147  # shift register
            while {
              Match Pattern(regular expression=",", string=s5) -> (after substring=w150, before substring=w151)
              case (w151) {
                frame "1", Default {
                  call "Read_Write_VISA.gvi"(VISA_IN=w126, CMD="@DO 43 1#", ERROR_IN=w149) -> (ERROR_OUT=w152)
                }
                frame "2" {
                  call "Read_Write_VISA.gvi"(VISA_IN=w126, CMD="@DO 44 1#", ERROR_IN=w149) -> (ERROR_OUT=w152)
                }
                frame "3" {
                  call "Read_Write_VISA.gvi"(VISA_IN=w126, CMD="@DO 45 1#", ERROR_IN=w149) -> (ERROR_OUT=w152)
                }
                frame "5" {
                  call "Read_Write_VISA.gvi"(VISA_IN=w126, CMD="@DO 46 1#", ERROR_IN=w149) -> (ERROR_OUT=w152)
                }
                frame "10" {
                  call "Read_Write_VISA.gvi"(VISA_IN=w126, CMD="@DO 47 1#", ERROR_IN=w149) -> (ERROR_OUT=w152)
                }
                frame "20" {
                  call "Read_Write_VISA.gvi"(VISA_IN=w126, CMD="@DO 48 1#", ERROR_IN=w149) -> (ERROR_OUT=w152)
                }
                frame "40" {
                  call "Read_Write_VISA.gvi"(VISA_IN=w126, CMD="@DO 49 1#", ERROR_IN=w149) -> (ERROR_OUT=w152)
                }
                frame "50" {
                  call "Read_Write_VISA.gvi"(VISA_IN=w126, CMD="@DO 34 1#", ERROR_IN=w149) -> (ERROR_OUT=w152)
                }
                frame "100" {
                  call "Read_Write_VISA.gvi"(VISA_IN=w126, CMD="@DO 35 1#", ERROR_IN=w149) -> (ERROR_OUT=w152)
                }
                frame "200" {
                  call "Read_Write_VISA.gvi"(VISA_IN=w126, CMD="@DO 36 1#", ERROR_IN=w149) -> (ERROR_OUT=w152)
                }
                frame "400" {
                  call "Read_Write_VISA.gvi"(VISA_IN=w126, CMD="@DO 37 1#", ERROR_IN=w149) -> (ERROR_OUT=w152)
                }
                frame "500" {
                  call "Read_Write_VISA.gvi"(VISA_IN=w126, CMD="@DO 38 1#", ERROR_IN=w149) -> (ERROR_OUT=w152)
                }
                frame "1000" {
                  call "Read_Write_VISA.gvi"(VISA_IN=w126, CMD="@DO 39 1#", ERROR_IN=w149) -> (ERROR_OUT=w152)
                }
                frame "2000" {
                  call "Read_Write_VISA.gvi"(VISA_IN=w126, CMD="@DO 40 1#", ERROR_IN=w149) -> (ERROR_OUT=w152)
                }
                frame "4000" {
                  call "Read_Write_VISA.gvi"(VISA_IN=w126, CMD="@DO 41 1#", ERROR_IN=w149) -> (ERROR_OUT=w152)
                }
                frame "0" {
                  # Для измерения тока К.З.
                  # Схема сопротивления
                  # 1 Ом + 1 Ом токовый резистор
                  w152 = w149
                }
              }
              Is Empty String Or Path(string/path=w150) -> w153
              next s5 = w150
              stop if w153
            }
            call "Read_Write_VISA.gvi"(VISA_IN=w126, CMD="@DO 42 0#", ERROR_IN=w152) -> (ERROR_OUT=w144)
            Increment(x=$"VAC Load Counter") -> w146
            $Graph_3 <- w143
          }
        }
        call "Enqueue Message (Single).gvi"(message queue in=w35, message="Watchdog", error in=w144) -> (error out=w154)
        case (w125) {
          frame False, Default {
            w39 = w154
          }
          frame True {
            call "Enqueue Message (Single).gvi"(message queue in=w35, message="VAC", message data=w145, error in=w154) -> (error out=w39)
          }
        }
        $"VAC Load Counter" <- w146
        w40 = s3
        w41 = default
      }
      frame "Prepare CVM" {
        Property Node(instance in=s4) -> ("VISA Resource"=w155, "Physical Channel"=w156, instance out=w42)
        call "DAQmx Read (Analog 2D DBL NChan NSamp).gvi"(task in=w156, error in=w38, number of samples per channel=1) -> (error out=w157, data=w158)
        Array Index(array=w158) -> (out0[2, 0]=w159)
        Multiply(w159, 4) -> w160
        C Code Node("x"=w160) -> ("y"=w161, Error Out=w162)
        ~~~
        if(x>-1 && x<=1)
          y = 0;
        if(x>1 && x<=10)
          y = 1;
        if(x>10 && x<=20)
          y = 2;
        if(x>20 && x<=30)
          y = 3;
        ~~~
        $"Voltage Range" <- w161
        # Voltage Range
        case (w161) {
          frame 0, Default {
            call "CMD_Iteration.gvi"(VISA_IN=w155, ARRAY_IN=["@DO 51 1#", "@DO 52 1#", "@DO 53 0#"], ERROR_IN=w162) -> (VISA Answer=w165, ERROR_OUT=w163)
            w164 = 0.1
          }
          frame 1 {
            call "CMD_Iteration.gvi"(VISA_IN=w155, ARRAY_IN=["@DO 51 1#", "@DO 52 1#", "@DO 53 1#"], ERROR_IN=w162) -> (VISA Answer=w165, ERROR_OUT=w163)
            w164 = 1
          }
          frame 2 {
            call "CMD_Iteration.gvi"(VISA_IN=w155, ARRAY_IN=["@DO 51 1#", "@DO 52 0#", "@DO 53 1#"], ERROR_IN=w162) -> (VISA Answer=w165, ERROR_OUT=w163)
            w164 = 0.5
          }
          frame 3 {
            # Div x0.25 works with 2 relay
            call "CMD_Iteration.gvi"(VISA_IN=w155, ARRAY_IN=["@DO 51 0#\n"], ERROR_IN=w162) -> (VISA Answer=w165, ERROR_OUT=w163)
            w164 = 0.25
          }
        }
        $"Voltage coeff" <- w164
        $"VISA Answer_2" <- w165
        Array Index(array=w158) -> (out0[3, 0]=w166)
        # Tip For Local Wiring Solution
        # Relay 1(50) 	DO 1- REP A x1
        # 		DO 0- AMP A x10
        #
        # Relay 2(51) 	DO 1-REP V x1
        # 		DO 0-DIV V x0.25
        # Relay 3(52) 	DO 1-REP V x1
        # 		DO 0-DIV V x0.5
        # Relay 4(53) 	DO 1-REP V x1
        # 		DO 0-AMP V x10
        C Code Node("x"=w166) -> ("y"=w167)
        ~~~
        if(x>-1 && x<=0.6)
          y = 0;
        if(x>0.6 && x<=6)
          y = 1;
        ~~~
        # Current Range
        case (w167) {
          frame 0, Default {
            call "CMD_Iteration.gvi"(VISA_IN=w155, ARRAY_IN=["@DO 50 0#"]) -> (ERROR_OUT=w168)
            w169 = 0.1
          }
          frame 1 {
            call "CMD_Iteration.gvi"(VISA_IN=w155, ARRAY_IN=["@DO 50 1#"]) -> (ERROR_OUT=w168)
            w169 = 1
          }
        }
        $"Current coeff" <- w169
        Merge Errors(w163, w168, w157) -> (error out=w39)
        w40 = s3
        w41 = default
      }
      frame "Fans Control" {
        Property Node(instance in=s4) -> ("VISA Resource"=w170, instance out=w42)
        Variant To Data(error in (no error)=w38, type=string "", variant=w37) -> (data=w171, error out=w172)
        case (w171) {
          frame "Turn All Off", Default {
            w173 = ["@DO 7 0#", "@DO 8 0#"]
          }
          frame "Turn All On" {
            w173 = ["@DO 7 1#", "@DO 8 1#"]
          }
          frame "Turn 1,2 On" {
            w173 = ["@DO 7 1#", "@DO 8 0#", ""]
          }
          frame "Turn 3,4 On" {
            w173 = ["@DO 8 1#", "@DO 7 0#"]
          }
        }
        call "CMD_Iteration.gvi"(VISA_IN=w170, ARRAY_IN=w173, ERROR_IN=w172) -> (ERROR_OUT=w39)
        w40 = s3
        w41 = default
      }
      frame "Heat Config" {
        Property Node(instance in=s4) -> ("VISA Resource"=w174, instance out=w42)
        Variant To Data(error in (no error)=w38, type=string "", variant=w37) -> (data=w175, error out=w176)
        case (w175) {
          frame "No Heat", Default {
            w177 = ["@PWM 9 0#"]
          }
          frame "50 Heat" {
            w177 = ["@PWM 9 125#"]
          }
          frame "100 Heat" {
            w177 = ["@PWM 9 255#"]
          }
        }
        call "CMD_Iteration.gvi"(VISA_IN=w174, ARRAY_IN=w177, ERROR_IN=w176) -> (ERROR_OUT=w39)
        w40 = s3
        w41 = default
      }
      frame "Optic Filter Config" {
        Property Node(instance in=s4) -> ("VISA Resource"=w178, instance out=w42)
        Variant To Data(error in (no error)=w38, type=string "", variant=w37) -> (data=w179, error out=w180)
        case (w179) {
          frame "None", Default {
            w181 = ["@SERV 3 90#", "@SERV 4 0#"]
          }
          frame "Filter 1" {
            w181 = ["@SERV 3 90#", "@SERV 4 0#", "@SERV 3 0#"]
          }
          frame "Filter 2" {
            w181 = ["@SERV 3 90#", "@SERV 4 0#", "@SERV 4 90#"]
          }
        }
        call "CMD_Iteration.gvi"(VISA_IN=w178, ARRAY_IN=w181, ERROR_IN=w180) -> (ERROR_OUT=w39)
        w40 = s3
        w41 = default
      }
      frame "Set PV Angle" {
        Property Node(instance in=s4) -> ("VISA Resource"=w182, instance out=w42)
        Variant To Data(error in (no error)=w38, type=u32 0, variant=w37) -> (data=w183, error out=w184)
        # Set angle limits for PV panels
        In Range And Coerce(lower limit=0, upper limit=180, x=w183) -> (coerced(x)=w185)
        Number To Decimal String(number=w185) -> (decimal integer string=w186)
        Concatenate Strings("@SERV 13 ", w186, " #") -> w187
        call "Read_Write_VISA.gvi"(VISA_IN=w182, CMD=w187, ERROR_IN=w184) -> (ERROR_OUT=w39)
        w40 = s3
        w41 = default
      }
      frame "Brightness Config" {
        Property Node(instance in=s4) -> ("VISA Resource"=w188, instance out=w42)
        Variant To Data(error in (no error)=w38, type=u32 0, variant=w37) -> (data=w189, error out=w190)
        # Set brightness limits
        In Range And Coerce(lower limit=0, upper limit=100, x=w189) -> (coerced(x)=w191)
        Number To Decimal String(number=w191) -> (decimal integer string=w192)
        Concatenate Strings("@DIM 6 ", w192, " #") -> w193
        call "Read_Write_VISA.gvi"(VISA_IN=w188, CMD=w193, ERROR_IN=w190) -> (ERROR_OUT=w39)
        w40 = s3
        w41 = default
      }
      frame "IR Thermometer" {
        Property Node(instance in=s4) -> ("VISA Resource"=w194, instance out=w42)
        Variant To Data(error in (no error)=w38, type=string "", variant=w37) -> (data=w195, error out=w196)
        case (w195) {
          frame "None", Default {
            w197 = "@SERV 5 0#"
          }
          frame "Panel 1" {
            w197 = "@SERV 5 50#"
          }
          frame "Panel 2" {
            w197 = "@SERV 5 90#"
          }
          frame "Panel 3" {
            w197 = "@SERV 5 120#"
          }
          frame "Panel 4" {
            w197 = "@SERV 5 150#"
          }
        }
        call "Read_Write_VISA.gvi"(VISA_IN=w194, CMD=w197, ERROR_IN=w196) -> (ERROR_OUT=w39)
        w40 = s3
        w41 = default
      }
      frame "Set Resistance" {
        Property Node(instance in=s4) -> ("VISA Resource"=w198, instance out=w42)
        Variant To Data(error in (no error)=w38, type=string "", variant=w37) -> (data=w199, error out=w200)
        # Disconnect ALL load
        w201 = ["@DO 42 1#", "@DO 34 0#", "@DO 35 0#", "@DO 36 0#", "@DO 37 0#", "@DO 38 0#", "@DO 39 0#", "@DO 40 0#", "@DO 41 0#", "@DO 43 0#", "@DO 44 0#", "@DO 45 0#", "@DO 46 0#", "@DO 47 0#", "@DO 48 0#", "@DO 49 0#"]
        call "CMD_Iteration.gvi"(VISA_IN=w198, ARRAY_IN=w201, ERROR_IN=w200) -> (VISA_OUT=w202, ERROR_OUT=w203)
        s6 = w199  # shift register
        while {
          Match Pattern(regular expression=",", string=s6) -> (after substring=w204, before substring=w205)
          case (w205) {
            frame "1", Default {
              call "Read_Write_VISA.gvi"(VISA_IN=w202, CMD="@DO 43 1#", ERROR_IN=w203) -> (ERROR_OUT=w206)
            }
            frame "2" {
              call "Read_Write_VISA.gvi"(VISA_IN=w202, CMD="@DO 44 1#", ERROR_IN=w203) -> (ERROR_OUT=w206)
            }
            frame "3" {
              call "Read_Write_VISA.gvi"(VISA_IN=w202, CMD="@DO 45 1#", ERROR_IN=w203) -> (ERROR_OUT=w206)
            }
            frame "5" {
              call "Read_Write_VISA.gvi"(VISA_IN=w202, CMD="@DO 46 1#", ERROR_IN=w203) -> (ERROR_OUT=w206)
            }
            frame "10" {
              call "Read_Write_VISA.gvi"(VISA_IN=w202, CMD="@DO 47 1#", ERROR_IN=w203) -> (ERROR_OUT=w206)
            }
            frame "20" {
              call "Read_Write_VISA.gvi"(VISA_IN=w202, CMD="@DO 48 1#", ERROR_IN=w203) -> (ERROR_OUT=w206)
            }
            frame "40" {
              call "Read_Write_VISA.gvi"(VISA_IN=w202, CMD="@DO 49 1#", ERROR_IN=w203) -> (ERROR_OUT=w206)
            }
            frame "50" {
              call "Read_Write_VISA.gvi"(VISA_IN=w202, CMD="@DO 34 1#", ERROR_IN=w203) -> (ERROR_OUT=w206)
            }
            frame "100" {
              call "Read_Write_VISA.gvi"(VISA_IN=w202, CMD="@DO 35 1#", ERROR_IN=w203) -> (ERROR_OUT=w206)
            }
            frame "200" {
              call "Read_Write_VISA.gvi"(VISA_IN=w202, CMD="@DO 36 1#", ERROR_IN=w203) -> (ERROR_OUT=w206)
            }
            frame "400" {
              call "Read_Write_VISA.gvi"(VISA_IN=w202, CMD="@DO 37 1#", ERROR_IN=w203) -> (ERROR_OUT=w206)
            }
            frame "500" {
              call "Read_Write_VISA.gvi"(VISA_IN=w202, CMD="@DO 38 1#", ERROR_IN=w203) -> (ERROR_OUT=w206)
            }
            frame "1000" {
              call "Read_Write_VISA.gvi"(VISA_IN=w202, CMD="@DO 39 1#", ERROR_IN=w203) -> (ERROR_OUT=w206)
            }
            frame "2000" {
              call "Read_Write_VISA.gvi"(VISA_IN=w202, CMD="@DO 40 1#", ERROR_IN=w203) -> (ERROR_OUT=w206)
            }
            frame "4000" {
              call "Read_Write_VISA.gvi"(VISA_IN=w202, CMD="@DO 41 1#", ERROR_IN=w203) -> (ERROR_OUT=w206)
            }
            frame "0" {
              # Для измерения тока К.З.
              # Схема сопротивления
              # 1 Ом + 1 Ом токовый резистор
              w206 = w203
            }
          }
          Is Empty String Or Path(string/path=w204) -> w207
          next s6 = w204
          stop if w207
        }
        # Connect Load
        call "Read_Write_VISA.gvi"(VISA_IN=w198, CMD="@DO 42 0#", ERROR_IN=w206) -> (ERROR_OUT=w39)
        w40 = s3
        w41 = default
      }
      frame "Reset Resistance" {
        Property Node(instance in=s4) -> ("VISA Resource"=w208, instance out=w42)
        # Размыкаются всё реле, сопротивление- бесконечность
        w209 = ["@DO 42 1#", "@DO 34 1#", "@DO 35 1#", "@DO 36 1#", "@DO 37 1#", "@DO 38 1#", "@DO 39 1#", "@DO 40 1#", "@DO 41 1#", "@DO 43 1#", "@DO 44 1#", "@DO 45 1#", "@DO 46 1#", "@DO 47 1#", "@DO 48 1#", "@DO 49 1#"]
        # Сопротивление в начальное положение
        call "CMD_Iteration.gvi"(VISA_IN=w208, ARRAY_IN=w209, ERROR_IN=w38) -> (ERROR_OUT=w39)
        w40 = s3
        w41 = default
      }
      frame "Watchdog" {
        Property Node(instance in=s4) -> ("Physical Channel"=w210, "VISA Resource"=w211, instance out=w42)
        call "DAQmx Read (Analog 2D DBL NChan NSamp).gvi"(task in=w210, number of samples per channel=1) -> (data=w212)
        Array Index(array=w212) -> (out0[1, 0]=w213)
        Multiply(w213, 4) -> w214
        Multiply(w214, $"Voltage coeff") -> w215
        Feedback Node(input=w216) -> w217
        Build Array(w217, w215) -> w216
        $Voltage_Graph <- w216
        $V_real <- w215
        Array Index(array=w212) -> (out0[0, 0]=w218)
        Divide(x=w218, y=70) -> w219
        Multiply(w219, 1000) -> w220
        Multiply(w220, $"Current coeff") -> w221
        $Current_real <- w221
        call "Read_Write_VISA.gvi"(VISA_IN=w211, CMD="@TIME 10 ?#", ERROR_IN=w38) -> (ERROR_OUT=w222)
        call "Read_Write_VISA.gvi"(VISA_IN=w211, CMD="@LUX 10 1#", ERROR_IN=w222) -> (OUTPUT=w223, TAG=w224, ERROR_OUT=w225)
        $LUX_2 <- w224
        call "Read_Write_VISA.gvi"(VISA_IN=w223, CMD="@TEMP 12 0#", ERROR_IN=w225) -> (TAG=w226, ERROR_OUT=w227)
        $TEMP_2 <- w226
        call "DAQmx Read (Analog 1D Wfm NChan NSamp).gvi"(task in=w210, error in=w227, number of samples per channel=1) -> (error out=w228, data=w229)
        $Chart <- w229
        Feedback Node(input=w230) -> w231
        Build Array(w231, w221) -> w230
        $Current_Graph <- w230
        call "Enqueue Message (Single).gvi"(message queue in=w35, message="Wait For Event", error in=w228) -> (error out=w39)
        w40 = s3
        w41 = default
      }
      frame "Error" {
        Variant To Data(error in (no error)=w38, type=no error, variant=w37) -> (data=w232, error out=w39)
        # #CodeRecommended - If you ever change the name of this "Error" message, you'll need to update the name in the Check Loop Error.vi as well.
        call "Display Error.gvi"(error in=w232)
        w40 = s3
        w41 = default
        w42 = s4
      }
      frame "Exit" {
        Generate User Event(event data=TRUE, user event=w25) -> (error out=w233)
        Release Queue(error in=w38, queue=w35) -> (error out=w234)
        Property Node(instance in=s4) -> ("VISA Resource"=w235, "Physical Channel"=w236)
        call "DAQmx Stop Task.gvi"(task in=w236) -> (error out=w237)
        call "Close (Instr).gvi"(session in=w235, error in=w237) -> (error out=w238)
        Merge Errors(w238, w233, w234) -> (error out=w39)
        w40 = s3
        w41 = TRUE
        w42 = default
      }
      frame Default {
        w239 = "The invalid message string \"%s\" was received in the Message Handling Loop."
        Format Into String(formatString=w239, w36) -> w240
        call "Build Error Cluster.gvi"(code=1, description=w240) -> (error out=w39)
        w40 = s3
        w41 = default
        w42 = s4
      }
    }
    call "Error Handler - Message Handling Loop.gvi"(message queue in=w35, error in=w39) -> (dup error in=w241)
    $Output <- w39
    next s3 = w40
    next s4 = w42
    stop if w41
  }
  $"API Key_2" <- "zYUbuW0YNkg1G__lXfJiGVBNWME-HlVd2a5NUHp-IP"
  $"Server Url" <- "https://api.systemlinkcloud.com/"
  $SendStringToCloud <- "SendStringToCloud"
  $SendDoubleToCloud <- "SendDoubleToCloud"
  $"Exit 2" <- FALSE
  w242 = bool FALSE  # Stop Event
  Create User Event[EventName="Stop Event"](user event data type=w242) -> (error out=w243, user event out=w244)
  call "Create All Message Queues.gvi"(error in=w243) -> (message queues=w245, error out=w246)
  Property Node(instance in=w245) -> ("UI"=w247)
  s7 = "UI Data.gtype" {all zero or empty}  # shift register
  while {
    call "Dequeue Message.gvi"(message queue in=w247, error in=w246) -> (message queue out=w248, message=w249, message data=w250, error out=w251)
    # s7: Data
    # w244: Stop Event
    case (w249) ignore case {  # Message Cases
      frame "Initialize" {
        Property Node(instance in=s7, "String <Replace Me>"="Initial Message") -> (instance out=w253)
        call "Enqueue Message (Single).gvi"(message queue in=w248, message="Update Display", message data="Initial Message", error in=w251) -> (error out=w252)
        Property Node(instance in=reference to "MV-Panel Configuration", "ValueSignaling"="none")
        # Bundle a sample string value.
        Property Node(instance in=reference to "PV-Panel Cofiguration", "ValueSignaling"="none")
        Property Node(instance in=reference to "PV-Temperature, ºC", "ValueSignaling"=0)
        Property Node(instance in=reference to "MV-Heating", "ValueSignaling"="none")
        Property Node(instance in=reference to "PV-Heating", "ValueSignaling"="none")
        Property Node(instance in=reference to "MV-Cooling", "ValueSignaling"="none")
        Property Node(instance in=reference to "PV-LightIntensity, W/m2", "ValueSignaling"=0)
        Property Node(instance in=reference to "PV-Cooling", "ValueSignaling"="none")
        Property Node(instance in=reference to "MV-Light Power", "ValueSignaling"="none")
        Property Node(instance in=reference to "PV-Panel Tilt Angle, º", "ValueSignaling"=0)
        Property Node(instance in=reference to "PV-Optical Filter", "ValueSignaling"="none")
        Property Node(instance in=reference to "MV-Optical Filter", "ValueSignaling"="none")
        Property Node(instance in=reference to "PV-LoadR4", "ValueSignaling"="none")
        Property Node(instance in=reference to "PV-Voltage, V", "ValueSignaling"=0)
        Property Node(instance in=reference to "MV-Panel Tilt Angle", "ValueSignaling"="none")
        Property Node(instance in=reference to "PV-LoadR3", "ValueSignaling"="none")
        Property Node(instance in=reference to "PV-Current, mA", "ValueSignaling"=0)
        Property Node(instance in=reference to "MV-LoadR1", "ValueSignaling"="none")
        Property Node(instance in=reference to "PV-LoadR2", "ValueSignaling"="none")
        Property Node(instance in=reference to "PV-LoadR,Ohm", "ValueSignaling"=0)
        Property Node(instance in=reference to "MV-LoadR2", "ValueSignaling"="none")
        Property Node(instance in=reference to "PV-LoadR1", "ValueSignaling"="none")
        Property Node(instance in=reference to "MV-LoadR3", "ValueSignaling"="none")
        Property Node(instance in=reference to "MV-LoadR4", "ValueSignaling"="none")
        w254 = default
      }
      frame "Something" {
        # #CodeNeeded - Perform whatever actions correspond to the "Something" message.
        # Send string to "Update Display" message
        call "Enqueue Message (Single).gvi"(message queue in=w248, message="Update Display", message data="\"Do Something\" button pressed", error in=w251) -> (error out=w252)
        w253 = s7
        w254 = default
      }
      frame "Something Else" {
        # #CodeNeeded - Perform whatever actions correspond to the "Something Else" message.
        # Send string to "Update Display" message
        call "Enqueue Message (Single).gvi"(message queue in=w248, message="Update Display", message data="\"Do Something Else\" button pressed", error in=w251) -> (error out=w252)
        w253 = s7
        w254 = default
      }
      frame "Update Display" {
        # #CodeRecommended - If you wish to decouple the Message Handling Loop from your user interface, consider creating User Events (like the "Stop" event in this VI) to message the Event Handling Loop whenever the user interface needs updating.
        Variant To Data(error in (no error)=w251, type=string "", variant=w250) -> (data=w255, error out=w252)
        $"Display <Replace Me>" <- w255
        w253 = s7
        w254 = default
      }
      frame "Error" {
        Variant To Data(error in (no error)=w251, type=no error, variant=w250) -> (data=w256, error out=w252)
        # #CodeRecommended - Consider creating a system for logging errors in some way. These errors are for notification purposes only. Handling of specific errors should be performed in the message frames that generated the error.
        # #CodeRecommended - If you ever change the name of this "Error" message, you'll need to update the name in the Check Loop Error.vi as well.
        call "Display Error.gvi"(error in=w256)
        w253 = s7
        w254 = default
      }
      frame "---Copy This Frame---" {
        Merge Errors(w251) -> (error out=w252)
        w253 = s7
        w254 = default
      }
      frame "Exit" {
        # Release the message queue reference
        Release Queue(error in=w251, queue=w248) -> (error out=w257)
        # #CodeNeeded - Add any required cleanup code here. Note that if 'Exit' was called as a result of an error, an error dialog will be displayed. Add any custom error handling for an 'Exit' condition here as well.
        Generate User Event(event data=TRUE, user event=w244) -> (error out=w258)
        Merge Errors(w258, w257) -> (error out=w252)
        # Stop the VI
        $"Exit 2" <- TRUE
        w253 = s7
        w254 = TRUE
      }
      frame Default {
        w259 = "The invalid message string \"%s\" was received in the Message Handling Loop."
        Format Into String(formatString=w259, w249) -> w260
        call "Build Error Cluster.gvi"(code=1, description=w260) -> (error out=w252)
        w253 = s7
        w254 = default
      }
      frame "SendDoubleToCloud" {
        call "Open Configuration API Key.gvi"(server url=$"Server Url", api key=$"API Key_2", error in=w251) -> (configuration=w261)
        Variant To Data(type=string[] [], variant=w250) -> (data=w262)
        Array Index(array=w262) -> (out0[0]=w263, out1[1]=w264)
        Floating Point String To Number(string=w264) -> (number=w265)
        Build Array(w263) -> w266
        call "Query Tags.gvi"(paths=w266, configuration=w261) -> (tags=w267, error out=w268)
        Array Index(array=w267) -> (out0[_]=w269)
        Property Node(instance in=w269) -> ("Path"=w270, "Datatype"=w271)
        call "Open Tag.gvi"(path=w270, data type=w271, error in=w268, configuration=w261) -> (tag=w272, error out=w273)
        call "Write Tag (DBL).gvi"(tag in=w272, value=w265, error in=w273) -> (tag out=w274, error out=w275)
        call "Close Tag (Single).gvi"(tag=w274, error in=w275) -> (error out=w276)
        call "Close Configuration.gvi"(configuration=w261, error in=w276) -> (error out=w252)
        w253 = s7
        w254 = default
      }
      frame "SendStringToCloud" {
        call "Open Configuration API Key.gvi"(server url=$"Server Url", api key=$"API Key_2", error in=w251) -> (configuration=w277, error out=w278)
        Variant To Data(type=string[] [], variant=w250) -> (data=w279)
        Array Index(array=w279) -> (out0[0]=w280, out1[1]=w281)
        Build Array(w280) -> w282
        call "Query Tags.gvi"(paths=w282, configuration=w277) -> (tags=w283)
        Array Index(array=w283) -> (out0[_]=w284)
        Property Node(instance in=w284) -> ("Path"=w285, "Datatype"=w286)
        call "Open Tag.gvi"(path=w285, data type=w286, error in=w278, configuration=w277) -> (tag=w287, error out=w288)
        call "Write Tag (String).gvi"(tag in=w287, value=w281, error in=w288) -> (tag out=w289, error out=w290)
        call "Close Tag (Single).gvi"(tag=w289, error in=w290) -> (error out=w291)
        call "Close Configuration.gvi"(configuration=w277, error in=w291) -> (error out=w252)
        w253 = s7
        w254 = default
      }
    }
    call "Error Handler - Message Handling Loop.gvi"(message queue in=w248, error in=w252) -> (dup error in=w292)
    next s7 = w253
    stop if w254
  }
  Register For Events("Stop Event"=w244) -> (event registration refnum out=w293)
  s8 = w293  # shift register
  while {
    event (dynamic events = s8) {
      on "Do Something <Replace Me>" Value changed {
        # #CodeNeeded - Send the appropriate message for this user interface event.
        call "Enqueue Message (Single).gvi"(message queue in=w247, message="Something") -> (message queue out=w296, error out=w295)
        w294 = default
      }
      on "Do Something Else <Replace Me>" Value changed {
        # #CodeNeeded - Send the appropriate message for this user interface event.
        call "Enqueue Message (Single).gvi"(message queue in=w247, message="Something Else") -> (message queue out=w296, error out=w295)
        w294 = default
      }
      on "Exit" Value changed {
        call "Enqueue Message (Single).gvi"(priority message=TRUE, message queue in=w247, message="Exit") -> (message queue out=w296, error out=w295)
        w294 = default
      }
      on dynamic event 0 {
        # The Message Handling Loop processed an "Exit" message, which fired this event to stop the Event Handling Loop.
        $"Display <Replace Me>" <- "\"Exit\" button pressed"
        w294 = TRUE
        w295 = default
        w296 = w247
      }
      on "Window" Close? {
        call "Enqueue Message (Single).gvi"(priority message=TRUE, message queue in=w247, message="Exit") -> (message queue out=w296)
        Event Filter("Discard?"=TRUE)
        w294 = default
        w295 = default
      }
      on "PV-Current, mA" Value changed {
        Event Data() -> ("New Value"=w297)
        Number To Fractional String(number=w297) -> (F-format string=w298)
        Build Array("PV-Current", w298) -> w299
        call "Enqueue Message (Single).gvi"(message queue in=w247, message=$SendDoubleToCloud, message data=w299) -> (message queue out=w296)
        w294 = default
        w295 = default
      }
      on "PV-LoadR,Ohm" Value changed {
        Event Data() -> ("New Value"=w300)
        Number To Fractional String(number=w300) -> (F-format string=w301)
        Build Array("PV-LoadR", w301) -> w302
        call "Enqueue Message (Single).gvi"(message queue in=w247, message=$SendDoubleToCloud, message data=w302) -> (message queue out=w296)
        w294 = default
        w295 = default
      }
      on "PV-Voltage, V" Value changed {
        Event Data() -> ("New Value"=w303)
        Number To Fractional String(number=w303) -> (F-format string=w304)
        Build Array("PV-Voltage", w304) -> w305
        call "Enqueue Message (Single).gvi"(message queue in=w247, message=$SendDoubleToCloud, message data=w305) -> (message queue out=w296)
        w294 = default
        w295 = default
      }
      on "PV-Temperature, ºC" Value changed {
        Event Data() -> ("New Value"=w306)
        Number To Fractional String(number=w306) -> (F-format string=w307)
        Build Array("PV-Temperature", w307) -> w308
        call "Enqueue Message (Single).gvi"(message queue in=w247, message=$SendDoubleToCloud, message data=w308) -> (message queue out=w296)
        w294 = default
        w295 = default
      }
      on "PV-LightIntensity, W/m2" Value changed {
        Event Data() -> ("New Value"=w309)
        Number To Fractional String(number=w309) -> (F-format string=w310)
        Build Array("PV-LigthtIntensity", w310) -> w311
        call "Enqueue Message (Single).gvi"(message queue in=w247, message=$SendDoubleToCloud, message data=w311) -> (message queue out=w296)
        w294 = default
        w295 = default
      }
      on "PV-Panel Tilt Angle, º" Value changed {
        Event Data() -> ("New Value"=w312)
        Number To Fractional String(number=w312) -> (F-format string=w313)
        Build Array("PV-Panel Tilt Angle", w313) -> w314
        call "Enqueue Message (Single).gvi"(message queue in=w247, message=$SendDoubleToCloud, message data=w314) -> (message queue out=w296)
        w294 = default
        w295 = default
      }
      on "PV-Panel Cofiguration" Value changed {
        Event Data() -> ("New Value"=w315)
        Build Array("PV-Panel Configuration", w315) -> w316
        call "Enqueue Message (Single).gvi"(message queue in=w247, message=$SendStringToCloud, message data=w316) -> (message queue out=w296)
        w294 = default
        w295 = default
      }
      on "PV-Cooling" Value changed {
        Event Data() -> ("New Value"=w317)
        Build Array("PV-Cooling", w317) -> w318
        call "Enqueue Message (Single).gvi"(message queue in=w247, message=$SendStringToCloud, message data=w318) -> (message queue out=w296)
        w294 = default
        w295 = default
      }
      on "PV-Heating" Value changed {
        Event Data() -> ("New Value"=w319)
        Build Array("PV-Heating", w319) -> w320
        call "Enqueue Message (Single).gvi"(message queue in=w247, message=$SendStringToCloud, message data=w320) -> (message queue out=w296)
        w294 = default
        w295 = default
      }
      on "PV-Optical Filter" Value changed {
        Event Data() -> ("New Value"=w321)
        Build Array("PV-Optical Filter", w321) -> w322
        call "Enqueue Message (Single).gvi"(message queue in=w247, message=$SendStringToCloud, message data=w322) -> (message queue out=w296)
        w294 = default
        w295 = default
      }
      on "PV-LoadR1" Value changed {
        Event Data() -> ("New Value"=w323)
        Build Array("PV-LoadR1", w323) -> w324
        call "Enqueue Message (Single).gvi"(message queue in=w247, message=$SendStringToCloud, message data=w324) -> (message queue out=w296)
        w294 = default
        w295 = default
      }
      on "PV-LoadR2" Value changed {
        Event Data() -> ("New Value"=w325)
        Build Array("PV-LoadR2", w325) -> w326
        call "Enqueue Message (Single).gvi"(message queue in=w247, message=$SendStringToCloud, message data=w326) -> (message queue out=w296)
        w294 = default
        w295 = default
      }
      on "PV-LoadR3" Value changed {
        Event Data() -> ("New Value"=w327)
        Build Array("PV-LoadR3", w327) -> w328
        call "Enqueue Message (Single).gvi"(message queue in=w247, message=$SendStringToCloud, message data=w328) -> (message queue out=w296)
        w294 = default
        w295 = default
      }
      on "PV-LoadR4" Value changed {
        Event Data() -> ("New Value"=w329)
        Build Array("PV-LoadR4", w329) -> w330
        call "Enqueue Message (Single).gvi"(message queue in=w247, message=$SendStringToCloud, message data=w330) -> (message queue out=w296)
        w294 = default
        w295 = default
      }
    }
    call "Error Handler - Event Handling Loop.gvi"(message queue in=w296, error in=w295) -> (dup error in=w331)
    stop if w294
  }
  Unregister For Events(error in=w331, event registration refnum=s8) -> (error out=w332)
  Merge Errors(w332, w292) -> (error out=w333)
  Destroy User Event(error in=w333, user event=w244)
  disable {
    frame Enabled { }
    frame Disabled {
      call "Initialize.gvi"(device name="cam0") -> (session out=w334, error out=w335)
      call "Configure Grab.gvi"(session in=w334, error in=w335) -> (session out=w336, error out=w337)
      call "Create Image.gvi"(image name="image_1") -> (new image=w338)
      while {
        call "Grab.gvi"(session in=w336, error in=w337, image in=w338) -> (session out=w339, error out=w340)
        stop if $Stop
      }
      call "Close.gvi"(session=w339, error in=w340)
    }
  }
